# Dynamo graph Building Blocks of Programs - Color.dyn (Dynamo 0.8.1.1265)

code_block = CodeBlock { 0..30..#100; }
code_block_2 = CodeBlock(t=code_block) { t; Math.Sin(Math.RadiansToDegrees(t)); Math.Cos(Math.RadiansToDegrees(t)); }
byCoordinates = Point.ByCoordinates(x=code_block_2.t, y=code_block_2.out1, z=code_block_2.out2)
byPoints = PolyCurve.ByPoints(points=byCoordinates)
number_slider = DoubleSlider(0.3, range=0..1 step 0.001)
pointAtParameter = Curve.PointAtParameter(curve=byPoints, param=number_slider)
distanceTo = Geometry.DistanceTo(geometry=byCoordinates, other=pointAtParameter)
code_block_3 = CodeBlock { 0.01; }
code_block_4 = CodeBlock { 1; }
remapRange = Math.RemapRange(numbers=distanceTo, newMin=code_block_3, newMax=code_block_4)
byCenterPointRadius = Sphere.ByCenterPointRadius(centerPoint=byCoordinates, radius=remapRange)
code_block_5 = CodeBlock { 0; 255; }
byARGB = Color.ByARGB(r=code_block_5.out1, g=code_block_5.out0, b=code_block_5.out0)
byARGB_2 = Color.ByARGB(r=code_block_5.out0, g=code_block_5.out1, b=code_block_5.out1)
create = List.Create(byARGB, byARGB_2)
code_block_6 = CodeBlock { 0; 1; }
remapRange_2 = Math.RemapRange(numbers=distanceTo, newMin=code_block_6.out0, newMax=code_block_6.out1)
color_range = ColorRange(create, arg2=remapRange_2)
byGeometryColor = Display.ByGeometryColor(byCenterPointRadius, color_range)
