# Dynamo graph Building Blocks of Programs - Data (1).dyn (Dynamo 1.3.3.4651)

number = DoubleInput(0)
integer_slider = IntegerSlider(9, range=0..10 step 1)
radius = DoubleSlider(1, range=0..2 step 0.01)
number_2 = DoubleInput(2)
mul = radius * number_2
thickness = DoubleSlider(1.49, range=0..2 step 0.01)
add = mul + thickness
sequence = Sequence(start=number, amount=integer_slider, step=add, lacing=Longest)
pointY = DoubleSlider(0, range=0..2 step 0.01)
pointZ = DoubleSlider(0.04, range=0..2 step 0.01)
byCoordinates = Point.ByCoordinates(x=sequence, y=pointY, z=pointZ)
ZAxis = Vector.ZAxis()
byOriginNormal = Plane.ByOriginNormal(origin=byCoordinates, normal=ZAxis)
byPlaneRadius = Circle.ByPlaneRadius(plane=byOriginNormal, radius=radius)
height = DoubleSlider(1.74, range=0..2 step 0.01)
extrude = Curve.Extrude(curve=byPlaneRadius, distance=height)
thicken = Surface.Thicken(surface=extrude, thickness=thickness)
