# Dynamo graph Building Blocks of Programs - Logic.dyn "spaces_Y5ZuHF3yuXFWp1C46ZSo_uploads_git-blob-3dd537ae7890f5077d2628bc290ead1b17fcaff9_Building Blocks of Programs - Logic" (Dynamo 3.2.2.5494)

# group: Part II: From Logic to Geometry
number = DoubleInput(0)
number_2 = DoubleInput(360)
number_3 = DoubleInput(5)
range = Range(start=number, end=number_2, step=number_3, lacing=Longest)
degreesToRadians = Math.DegreesToRadians(degrees=range)
number_slider = DoubleSlider(3.38, range=1..4 step 0.01)
mul = range * number_slider
sin = Math.Sin(angle=mul)
number_slider_2 = DoubleSlider(0.9, range=0..1 step 0.01)
mul_2 = sin * number_slider_2
byCoordinates = Point.ByCoordinates(x=degreesToRadians, y=mul_2)
byPoints = PolyCurve.ByPoints(points=byCoordinates)

# group: Part II: From Logic to Geometry
number_4 = DoubleInput(0)
number_5 = DoubleInput(100)
number_6 = DoubleInput(1)
sequence = Sequence(start=number_4, amount=number_5, step=number_6, lacing=Longest)
number_7 = DoubleInput(2)
mod = sequence % number_7
number_8 = DoubleInput(0)
eq = mod == number_8

# group: Part II: From Logic to Geometry
number_9 = DoubleInput(0)
number_10 = DoubleInput(1)
remapRange = Math.RemapRange(numbers=sequence, newMin=number_9, newMax=number_10)

# group: Part II: From Logic to Geometry
pointAtParameter = Curve.PointAtParameter(curve=byPoints, param=remapRange)

# group (continued): Part II: From Logic to Geometry
filterByBoolMask = List.FilterByBoolMask(list=pointAtParameter, mask=eq)

# group: Part II: From Logic to Geometry
number_slider_3 = DoubleSlider(0.025, range=0..100 step 0.1)
number_slider_4 = DoubleSlider(0.5, range=0..100 step 0.1)
number_slider_5 = DoubleSlider(0.2, range=0..1 step 0.05)
byLengths = Cuboid.ByLengths(origin=filterByBoolMask.out, width=number_slider_3, length=number_slider_4, height=number_slider_5)
number_slider_6 = DoubleSlider(0.15, range=0..100 step 0.1)
number_slider_7 = DoubleSlider(0.01, range=0..100 step 0.1)
byLengths_2 = Cuboid.ByLengths(origin=filterByBoolMask.in, width=number_slider_6, length=number_slider_6, height=number_slider_7)

# group: Part 1: Filtering a List
# Let's use logic to separate a list of numbers into a list of even numbers and a list of odd numbers.
number_11 = DoubleInput(0)
number_12 = DoubleInput(10)
number_13 = DoubleInput(1)
range_2 = Range(start=number_11, end=number_12, step=number_13)
number_14 = DoubleInput(2)
mod_2 = range_2 % number_14
number_15 = DoubleInput(0)
eq_2 = mod_2 == number_15
watch = Watch(eq_2)
filterByBoolMask_2 = List.FilterByBoolMask(list=range_2, mask=eq_2)
watch_2 = Watch(filterByBoolMask_2.in)
watch_3 = Watch(filterByBoolMask_2.out)
