# Dynamo graph Building Blocks of Programs - Math (1).dyn (Dynamo 0.8.1.1265)

XY = Plane.XY()
code_block = CodeBlock { 0..360..#100; }
rotate = Geometry.Rotate(arg1=XY, arg2=code_block, lacing=CrossProduct)
number = DoubleInput(0.01)
number_slider = DoubleSlider(149, range=0..149 step 0.1)
number_2 = DoubleInput(0.1)
number_sequence = NumberSeq(number, number_slider, number_2, lacing=Longest)
radiansToDegrees = Math.RadiansToDegrees(number_sequence)
cos = Math.Cos(radiansToDegrees)
E = Math.E()
number_slider_2 = DoubleSlider(0.259, range=0..1 step 0.001)
mul = number_sequence * number_slider_2
pow = Math.Pow(number=E, power=mul)
number_slider_3 = DoubleSlider(0.128, range=0..1 step 0.001)
mul_2 = pow * number_slider_3
mul_3 = cos * mul_2
sin = Math.Sin(radiansToDegrees)
mul_4 = sin * mul_2
byCoordinates = Point.ByCoordinates(x=mul_3, y=mul_4)
byPoints = PolyCurve.ByPoints(points=byCoordinates)
byCenterPointRadius = Circle.ByCenterPointRadius(centerPoint=byCoordinates, radius=number_sequence)
XY_2 = Plane.XY()
number_3 = DoubleInput(0)
number_4 = DoubleInput(360)
number_5 = DoubleInput(3.6)
number_range = NumberRange(number_3, number_4, number_5, lacing=Longest)
rotate_2 = Geometry.Rotate(byCoordinates, XY_2, number_range, lacing=CrossProduct)
