# Dynamo graph Building Blocks of Programs - Strings.dyn (Dynamo 0.8.1.1265)

string = StringInput(", \n")
string_2 = StringInput("The woods are lovely,dark and deep,But I have promises to keep,And miles to go before I sleep,And miles to go before I sleep.")
string_3 = StringInput(",")
split = String.Split(string_2, string_3)
string_4 = StringInput("And miles")
contains = String.Contains(str=split, searchFor=string_4)
filterByBoolMask = List.FilterByBoolMask(list=split, mask=contains)
number = DoubleInput(0)
getItemAtIndex = List.GetItemAtIndex(list=filterByBoolMask.in, index=number)
number_2 = DoubleInput(1)
getItemAtIndex_2 = List.GetItemAtIndex(list=filterByBoolMask.in, index=number_2)
join = String.Join(string, getItemAtIndex, getItemAtIndex_2)
watch = Watch(join)
