# Dynamo graph Chop.dyn (Dynamo 0.8.1.1942)

code_block = CodeBlock { 150; 20; }
byCoordinates = Point.ByCoordinates(x=code_block.out0, y=code_block.out0)
byCoordinates_2 = Point.ByCoordinates(x=code_block.out0, y=code_block.out1)
byStartPointEndPoint = Line.ByStartPointEndPoint(startPoint=byCoordinates, endPoint=byCoordinates_2)
code_block_2 = CodeBlock { 0..1..#10; }
pointAtParameter = Curve.PointAtParameter(curve=byStartPointEndPoint, param=code_block_2)
code_block_3 = CodeBlock { 2; }
chop = List.Chop(pointAtParameter, code_block_3)
byBestFitThroughPoints = Line.ByBestFitThroughPoints(chop)
watch = Watch(chop)
watch_2 = Watch(pointAtParameter)
