# Dynamo graph DynamoSampleWorkflow-Attractors.dyn (Dynamo 2.13.1.3887)

# note: ATTRACTOR POINT
# Scripting 101.
# An attractor point is a quick way to make variation across a field of objects.  It works by creating a grid of objects that have some parameter determined by the distance between the object and a point that moves around.
# To visualize what's going on, move the two sliders that control the location of the attractor point.
# note: Range syntax: 1 to 50, skipping by 5's
code_block = CodeBlock { 1..50..5; }
# note: Grid of points.
# To make, pass a series of numbers into at least two ports.  Change the lacing behavior of the node to "Cross product"
byCoordinates = Point.ByCoordinates(x=code_block, y=code_block, lacing=CrossProduct)
# note: Flatten the list because the hierarchy of rows and columns is not needed.  Compare the input to this node with the output.
flatten = List.Flatten(list=byCoordinates)
code_block_2 = CodeBlock { 0; }
number_slider = DoubleSlider(9.71, range=-10..60 step 0.1)
number_slider_2 = DoubleSlider(37.821, range=-25.546..60 step 0.1)
number_slider_3 = DoubleSlider(-7.786, range=-12.575..100 step 0.1)
# note: Attractor Point.  Move the input sliders to adjust the location of this point.
byCoordinates_2 = Point.ByCoordinates(x=number_slider, y=number_slider_2, z=number_slider_3)
# note: Finds the distance between the attractor point and the base point of the cylinders
distanceTo = Geometry.DistanceTo(geometry=flatten, other=byCoordinates_2, lacing=Longest)
# note: Formula to make the height of the cylinders react to the location of the attractor point.  Can be different from the formula controlling the radii.
code_block_3 = CodeBlock(x=distanceTo) { x/2; }
byCoordinates_3 = Vector.ByCoordinates(x=code_block_2, y=code_block_2, z=code_block_3)
add = Point.Add(point=byCoordinates, vectorToAdd=byCoordinates_3)
# note: Formula adjusts the amount of variation between the radii of the cylinders.  Try using a different formula.
code_block_4 = CodeBlock(x=distanceTo) { x/15; }
byPointsRadius = Cylinder.ByPointsRadius(startPoint=flatten, endPoint=add, radius=code_block_4)
# note: Add this new z-value (height) to the original grid points to get the top points for the cylinders.
byCenterPointRadius = Circle.ByCenterPointRadius(centerPoint=flatten, radius=code_block_4)
byPatch = Surface.ByPatch(closedCurve=byCenterPointRadius)
