# Dynamo graph DynamoSampleWorkflow-vase.dyn (Dynamo 2.13.1.3887)

bottom_radius = DoubleSlider(0.9, range=0..15 step 0.1)  # graph input
byCenterPointRadius = Circle.ByCenterPointRadius(radius=bottom_radius)
circle_2_radius = DoubleSlider(3.1, range=0..15 step 0.1)  # graph input
byCenterPointRadius_2 = Circle.ByCenterPointRadius(radius=circle_2_radius)
height = DoubleSlider(15, range=0..20 step 0.1)  # graph input
code_block = CodeBlock(x=height) { x*0.3; x*0.7; x; }
translate = Geometry.Translate(geometry=byCenterPointRadius_2, zTranslation=code_block.out0)
circle_3_radius = DoubleSlider(1.3, range=0..15 step 0.1)  # graph input
byCenterPointRadius_3 = Circle.ByCenterPointRadius(radius=circle_3_radius)
translate_2 = Geometry.Translate(geometry=byCenterPointRadius_3, zTranslation=code_block.out1)
top_radius = DoubleSlider(1.4, range=0..15 step 0.1)  # graph input
byCenterPointRadius_4 = Circle.ByCenterPointRadius(radius=top_radius)
translate_3 = Geometry.Translate(geometry=byCenterPointRadius_4, zTranslation=code_block.x)
create = List.Create(item0=byCenterPointRadius, item1=translate, item2=translate_2, item3=translate_3)
byLoft = Surface.ByLoft(crossSections=create)
