# Dynamo graph Flatten (1).dyn (Dynamo 0.8.1.1942)

code_block = CodeBlock { -250..150..#4; }
byCoordinates = Point.ByCoordinates(x=code_block, y=code_block, lacing=CrossProduct)
watch = Watch(byCoordinates)
flatten = Flatten(byCoordinates)
byPoints = PolyCurve.ByPoints(points=flatten)
watch_2 = Watch(byPoints)
