# Dynamo graph Functions_SphereByZ (1).dyn "Functions_SphereByZ" (Dynamo 2.13.0.3485)

code_block = CodeBlock { 0..100..#5; }
byCoordinates = Point.ByCoordinates(x=code_block, z=code_block, lacing=CrossProduct)
code_block_2 = CodeBlock(thePoint=byCoordinates) { sphereByZ(thePoint); }
code_block_3 = CodeBlock { 0..100..#5; }
byCoordinates_2 = Point.ByCoordinates(y=code_block_3, z=code_block_3)
code_block_4 = CodeBlock(thePoint=byCoordinates_2) { sphereByZ(thePoint); }
byCoordinates_3 = Point.ByCoordinates(lacing=CrossProduct)
code_block_5 = CodeBlock { -100..0..#5; }
code_block_6 = CodeBlock()
# ---------- code_block_6.designscript (15 lines) ----------
/* This is the parent
code block, defining a function.
The text here is a multi-line comment
and does not affect the code. */

def sphereByZ(inputPt)
{
	//get inputPt variables
	sphereRadius=(inputPt.Z)/20;

	//define sphere
	sphere=Sphere.ByCenterPointRadius(inputPt,sphereRadius);
	//finally, define the function's output with 'return'
	return=sphere;
};
# ----------------------------------------
code_block_7 = CodeBlock()
# ---------- code_block_7.designscript (7 lines) ----------
def sphereByZ(inputPt)
{
//get Z Value, use it to drive radius of sphere
sphereRadius=inputPt.Z/radiusRatio;
sphere=Sphere.ByCenterPointRadius(inputPt,sphereRadius);
return=sphere;
};
# ----------------------------------------
code_block_8 = CodeBlock { 0..100..#5; }
byCoordinates_4 = Point.ByCoordinates(x=code_block_8, y=code_block_8, z=code_block_8, lacing=CrossProduct)
number_slider = DoubleSlider(30, range=0..100 step 0.1)
code_block_9 = CodeBlock(Pt=byCoordinates_4, ratio=number_slider) { sphereByZ(Pt,ratio); }  # frozen
code_block_10 = CodeBlock { 0..100..#100; }
code_block_11 = CodeBlock(t=code_block_10) { t; 10*Math.Sin(Math.RadiansToDegrees(t/Math.PI)); 10*Math.Cos(Math.RadiansToDegrees(t/Math.PI))-50; }
byCoordinates_5 = Point.ByCoordinates(x=code_block_11.out2, y=code_block_11.out1, z=code_block_11.t, lacing=CrossProduct)  # frozen
number_slider_2 = DoubleSlider(7, range=0..100 step 0.1)
code_block_12 = CodeBlock(Pt=byCoordinates_5, ratio=number_slider_2) { sphereByZ(Pt,ratio); }
