# Dynamo graph GIS_OpenStreetMapRoads.dyn (Dynamo 2.18.0.4931)
# author: Autodesk, Inc.
# Creates geometry for OpenStreetMap roadway features.

# group: Input
# note: If unsure, just select Primary.
openstreetmap_server = CustomSelection("Primary", items={Primary: "https://overpass-api.de/api/interpreter", VK Maps (Russia): "https://maps.mail.ru/osm/tools/overpass/api/interpreter", Kumi Systems: "https://overpass.kumi.systems/api/interpreter"})  # graph input

# group: Input
# note: Making a call to the OpenStreetMap API requires a set of coordinates for the area of interest. This is to limit the amount of data that is returned. So, we need to define an area in Model Space.
select_boundary_object = ObjectSelection()  # 1 picked in the model; graph input

# group: Get coordinates of bounding box
# note: A "bounding box" is the smallest rectangle that completely surrounds and object (or collection of objects). In this group of nodes, we are getting the bottom-left and top-right corners of the bounding box for the object that was selected.
extents = Autodesk.AutoCAD.DynamoNodes.Object.Extents(object=select_boundary_object)
minPoint = BoundingBox.MinPoint(boundingBox=extents)
# note: OpenStreetMap expects all coordinates to be expressed in latitude and longitude, so we need to convert from drawing coordinates to lat/long.
transformPointToLL84 = Autodesk.Civil.DynamoNodes.AeccDocument.TransformPointToLL84(point=minPoint)
maxPoint = BoundingBox.MaxPoint(boundingBox=extents)
transformPointToLL84_2 = Autodesk.Civil.DynamoNodes.AeccDocument.TransformPointToLL84(point=maxPoint)
# note: This just joins the coordinates together in the way that OpenStreetMap requires.
code_block = CodeBlock(minLat=transformPointToLL84.Latitude, minLon=transformPointToLL84.Longitude, maxLat=transformPointToLL84_2.Latitude, maxLon=transformPointToLL84_2.Longitude) { bbox = minLat + "," + minLon + "," + maxLat + "," + maxLon; }

# group: Create query URL
output_format = StringInput("[out:json]")
semicolon = StringInput(";")
features = StringInput("way[\"highway\"~\"motorway|trunk|primary|secondary|tertiary\"]")
output = StringInput("out geom")
# note: This just joins various strings together to build a correctly-formatted URL.
code_block_2 = CodeBlock(endpoint=openstreetmap_server, outFormat=output_format, s=semicolon, features=features, bbox=code_block, output=output)
# ---------- code_block_2.designscript (3 lines) ----------
endpoint + "?data=" + outFormat + "[timeout:25]" + s
+ "(" + features + "(" + bbox + ")" + s + ")" + s
+ output + s;
# ----------------------------------------

# group: Get OpenStreetMap data
web_request = WebRequest(url=code_block_2)
# note: Take a look at the output of this node to see all of the data that we get from the query.
parseJSON = Data.ParseJSON(json=web_request)
code_block_3 = CodeBlock(data=parseJSON)
# ---------- code_block_3.designscript (5 lines) ----------
// This gets the lat/lon coordinates of each point
// (i.e., "node") that defines the road
geom = data["elements"]["geometry"];
lat = geom["lat"];
lon = geom["lon"];
# ----------------------------------------
code_block_4 = CodeBlock(data=parseJSON)
# ---------- code_block_4.designscript (4 lines) ----------
// This gets the classification of each road,
// but there are many other attributes available!
tags = data["elements"]["tags"];
category = tags["highway"];
# ----------------------------------------
code_block_5 = CodeBlock { "_link"; ""; }
# note: For this example graph, we'll consider road features classified as "links" to be the same as the others. For example, a feature classified as "motorway_link" will just be considered the same as "motorway."
replace = String.Replace(string=code_block_4.category, searchFor=code_block_5.out0, replaceWith=code_block_5.out1)

# group: Create Dynamo points
# note: Before we can create the geometry back in Model Space, we need to convert from latitude and longitude coordinates to drawing coordinates.
transformPointFromLL84 = Autodesk.Civil.DynamoNodes.AeccDocument.TransformPointFromLL84(latitude=code_block_3.lat, longitude=code_block_3.lon)

# group: Create polylines
current = Autodesk.AutoCAD.DynamoNodes.Document.Current()
modelSpace = Autodesk.AutoCAD.DynamoNodes.Document.ModelSpace(document=current)
byPoints = Autodesk.AutoCAD.DynamoNodes.Polyline.ByPoints(points=transformPointFromLL84, layer=replace, block=modelSpace)

layer = Autodesk.AutoCAD.DynamoNodes.Object.Layer(object=byPoints)

# group: Input
motorway_color = ColorPalette({R: 219, G: 79, B: 107, A: 255})
trunk_road_color = ColorPalette({R: 255, G: 127, B: 80, A: 255})
primary_road_color = ColorPalette({R: 244, G: 164, B: 96, A: 255})
secondary_road_color = ColorPalette({R: 144, G: 238, B: 144, A: 255})
tertiary_road_color = ColorPalette({R: 240, G: 248, B: 255, A: 255})

# group: Create color dictionary
# note: This is a list of the layer names that each color will be assigned to.
code_block_6 = CodeBlock()
# ---------- code_block_6.designscript (5 lines) ----------
["motorway",
"trunk",
"primary",
"secondary",
"tertiary"];
# ----------------------------------------
list_create = List.Create(item0=motorway_color, item1=trunk_road_color, item2=primary_road_color, item3=secondary_road_color, item4=tertiary_road_color)
# note: A dictionary is basically a really smart way to look something up. Take a look at the Dynamo Primer online for more info on how dictionaries work.
byKeysValues = DesignScript.Builtin.Dictionary.ByKeysValues(keys=code_block_6, values=list_create)

# group: Set layer colors
current_2 = Autodesk.AutoCAD.DynamoNodes.Document.Current()
uniqueItems = List.UniqueItems(list=layer)
layerByName = Autodesk.AutoCAD.DynamoNodes.Document.LayerByName(document=current_2, name=uniqueItems)
valueAtKey = DesignScript.Builtin.Dictionary.ValueAtKey(dictionary=byKeysValues, key=uniqueItems)
setColor = Autodesk.AutoCAD.DynamoNodes.LayerTableRecord.SetColor(layerTableRecord=layerByName, value=valueAtKey)

# group: Create Dynamo polycurves
byPoints_2 = PolyCurve.ByPoints(points=transformPointFromLL84)

# group: Get segment count and total length by roadway classification
# note: This node is really cool. What it's doing here is grouping the polycurves together based on the layer names.
groupByKey = List.GroupByKey(list=byPoints_2, keys=layer)
count = List.Count(list=groupByKey.groups@L2)
length = Curve.Length(curve=groupByKey.groups)
# note: Here we just get the total length of the roadway segments for each group and then round it off.
sum = Math.Sum(values=length)
round = Math.Round(number=sum)

# group: Format data for Dynamo Player
code_block_7 = CodeBlock { ["roadwayClass","segmentCount","totalLength"]; }
list_create_2 = List.Create(item0=groupByKey.uniqueKeys, item1=count, item2=round)
transpose = List.Transpose(lists=list_create_2)
# note: If you right-click on this node, you'll see that it is set to "Is Output." This will allow the data to show up in Dynamo Player after the graph is finished executing.
roadways_created = DesignScript.Builtin.Dictionary.ByKeysValues(keys=code_block_7, values=transpose@L2)  # graph output

# group: Reference
helpful_links_ctrl_click_to = CodeBlock()  # "Helpful links (Ctrl+Click to follow)"
# ---------- helpful_links_ctrl_click_to.designscript (5 lines) ----------
// Overpass API documentation
"https://wiki.openstreetmap.org/wiki/Overpass_API";

// Sandbox for testing various queries
"https://overpass-turbo.eu/";
# ----------------------------------------
