# Dynamo graph Geometry for Computational Design - Coordinate System (1).dyn (Dynamo 0.8.2.1770)

number_slider = DoubleSlider(0.6, range=-1..1 step 0.1)
number_slider_2 = DoubleSlider(-0.2, range=-1..1 step 0.1)
number_slider_3 = DoubleSlider(0.9, range=-1..1 step 0.1)
byCoordinates = Point.ByCoordinates(x=number_slider, y=number_slider_2, z=number_slider_3)
byOrigin = CoordinateSystem.ByOrigin(byCoordinates)
