# Dynamo graph Geometry for Computational Design - Curves (1).dyn (Dynamo 0.8.2.1770)

integer_slider = IntegerSlider(8, range=1..12 step 1)
integer_slider_2 = IntegerSlider(50, range=1..50 step 1)
code_block = CodeBlock(nPeriods=integer_slider, nPts=integer_slider_2) { 0..nPeriods..#nPts; 0..(Math.PI*nPeriods)..#nPts; }
radiansToDegrees = Math.RadiansToDegrees(code_block.out1)
sin = Math.Sin(radiansToDegrees)
byCoordinates = Point.ByCoordinates(x=code_block.out0, z=sin)
byControlPoints = NurbsCurve.ByControlPoints(byCoordinates)
byPoints = NurbsCurve.ByPoints(byCoordinates)
