# Dynamo graph Geometry for Computational Design - Geometry Overview.dyn (Dynamo 0.8.2.1770)

byCoordinates = Point.ByCoordinates()
integer_slider = IntegerSlider(2, range=1..10 step 1)
byCenterPointRadius = Sphere.ByCenterPointRadius(centerPoint=byCoordinates, radius=integer_slider)
number = DoubleInput(10)
byCoordinates_2 = Point.ByCoordinates(y=number)
integer_slider_2 = IntegerSlider(2, range=1..10 step 1)
byCenterPointRadius_2 = Sphere.ByCenterPointRadius(centerPoint=byCoordinates_2, radius=integer_slider_2)
