# Dynamo graph Geometry for Computational Design - Plane.dyn (Dynamo 0.8.2.1770)

byCoordinates = Point.ByCoordinates()
number_slider = DoubleSlider(0.6, range=-1..1 step 0.1)
number_slider_2 = DoubleSlider(-0.2, range=-1..1 step 0.1)
number_slider_3 = DoubleSlider(0.9, range=-1..1 step 0.1)
byCoordinates_2 = Vector.ByCoordinates(x=number_slider, y=number_slider_2, z=number_slider_3)
normalized = Vector.Normalized(byCoordinates_2)
number_slider_4 = DoubleSlider(3, range=0..10 step 0.1)
scale = Vector.Scale(vector=normalized, scale_factor=number_slider_4)
byOriginNormal = Plane.ByOriginNormal(origin=byCoordinates, normal=scale)
add = Point.Add(point=byCoordinates, vectorToAdd=scale)
byStartPointDirectionLength = Line.ByStartPointDirectionLength(startPoint=byCoordinates, direction=byCoordinates_2, length=number_slider_4)
