# Dynamo graph Geometry for Computational Design - Points (1).dyn (Dynamo 0.8.2.1770)

number_slider = DoubleSlider(-1.6, range=-10..10 step 0.1)
number_slider_2 = DoubleSlider(-1.2, range=-10..10 step 0.1)
number_slider_3 = DoubleSlider(1.3, range=-10..10 step 0.1)
byCoordinates = Point.ByCoordinates(x=number_slider, y=number_slider_2, z=number_slider_3)
byCylindricalCoordinates = CoordinateSystem.ByCylindricalCoordinates()
byCartesianCoordinates = Point.ByCartesianCoordinates(byCylindricalCoordinates, number_slider, number_slider_2, number_slider_2)
byCenterPointRadius = Sphere.ByCenterPointRadius()
explode = Geometry.Explode(byCenterPointRadius)
number_slider_4 = DoubleSlider(0.59, range=0..1 step 0.01)
number_slider_5 = DoubleSlider(0.33, range=0..1 step 0.01)
pointAtParameter = Surface.PointAtParameter(surface=explode, u=number_slider_4, v=number_slider_5)
