# Dynamo graph Geometry for Computational Design - Solids (1).dyn (Dynamo 0.8.3.2391)

code_block = CodeBlock { 100; }
byCenterPointRadius = Sphere.ByCenterPointRadius(radius=code_block)
faces = Topology.Faces(byCenterPointRadius)
surfaceGeometry = Face.SurfaceGeometry(faces)
code_block_2 = CodeBlock(surf=surfaceGeometry)
# ---------- code_block_2.designscript (7 lines) ----------
uParam = (0.15..0.85..#13);
vParam = (0..1..#20);
pt = surf<1>.PointAtParameter(uParam<2>,vParam<3>);
normal = surf<1>.NormalAtParameter(uParam<2>,vParam<3>);
startPt = pt.Translate(normal,5);
vec = normal.Reverse();
endPt = pt.Translate(vec, 4);
# ----------------------------------------
code_block_3 = CodeBlock { 2.5; 7; }
byPointsRadii = Cone.ByPointsRadii(code_block_2.startPt, code_block_2.endPt, code_block_3.out0, code_block_3.out1)
unionAll = Solid.UnionAll(byCenterPointRadius, byPointsRadii)
edges = Topology.Edges(unionAll)
code_block_4 = CodeBlock { 3; }
fillet = Solid.Fillet(unionAll, edges, code_block_4)
