# Dynamo graph Geometry for Computational Design - Vectors.dyn (Dynamo 0.8.2.1770)

byCoordinates = Point.ByCoordinates()
number_slider = DoubleSlider(0.5, range=-1..1 step 0.1)
number_slider_2 = DoubleSlider(-0.1, range=-1..1 step 0.1)
number_slider_3 = DoubleSlider(0.5, range=-1..1 step 0.1)
byCoordinates_2 = Vector.ByCoordinates(x=number_slider, y=number_slider_2, z=number_slider_3)
number_slider_4 = DoubleSlider(5.5, range=0..10 step 0.1)
byStartPointDirectionLength = Line.ByStartPointDirectionLength(startPoint=byCoordinates, direction=byCoordinates_2, length=number_slider_4)
normalized = Vector.Normalized(byCoordinates_2)
scale = Vector.Scale(vector=normalized, scale_factor=number_slider_4)
add = Point.Add(point=byCoordinates, vectorToAdd=scale)
