# Dynamo graph Lacing.dyn (Dynamo 0.8.1.1942)

code_block = CodeBlock { -50..50..#5; }
watch = Watch(code_block)
code_block_2 = CodeBlock { -50..50..#10; }
watch_2 = Watch(code_block_2)
byCoordinates = Point.ByCoordinates(x=watch, y=watch_2)
watch_3 = Watch(byCoordinates)
byPoints = PolyCurve.ByPoints(points=watch_3)
