# Dynamo graph Land_Earthwork.dyn (Dynamo 2.18.0.4931)
# author: Autodesk, Inc.
# Creates a text grid of cut/fill values between two surfaces, with an option to generate earthwork solids.

# group: Input
# note: The surface to compare to the base surface (typically a grading surface).
select_comparison_surface = ObjectSelection()  # 1 picked in the model; graph input
# note: The surface that becomes the "datum" for cut/fill measurements (typically the existing ground).
select_base_surface = ObjectSelection()  # 1 picked in the model; graph input
fill_color = ColorPalette({R: 0, G: 153, B: 4, A: 255})
cut_color = ColorPalette({R: 206, G: 1, B: 1, A: 255})
create_cut_fill_solids = BoolSelector(false)  # graph input
solids_layer = StringInput("C-GRAD-SLD")  # graph input

list_create = List.Create(item0=select_base_surface, item1=select_comparison_surface)

# group: Extract surface boundary polylines
# note: This extracts the 3D polyline boundary of a TIN surface. The extracted polyline is placed into Model Space.
extractBorder = Autodesk.Civil.DynamoNodes.TinSurface.ExtractBorder(tinSurface=list_create)
flatten = List.Flatten(list=extractBorder)
# note: After extracting the polylines, we need to bring them into Dynamo space as Dynamo polycurves so we can do more work with them.
geometry = Autodesk.AutoCAD.DynamoNodes.Object.Geometry(object=flatten)

# group: Get area of overlap between two surfaces
# Cut/fill calculations are only valid for the 2D area that is shared between two surfaces. We need to figure out what that area is so we can generate cut/fill text only within that region.
XY = Plane.XY()
# note: Pull the boundary curves onto the same plane.
pullOntoPlane = Curve.PullOntoPlane(curve=geometry, plane=XY)
# note: Create planar surfaces from the boundary curves.
byPatch = Surface.ByPatch(closedCurve=pullOntoPlane)
firstItem = List.FirstItem(list=byPatch)
lastItem = List.LastItem(list=byPatch)
# note: Compute the area of overlap (i.e., 'intersection') between the two surfaces.
intersect = Geometry.Intersect(geometry=firstItem, other=lastItem)
firstItem_2 = List.FirstItem(list=intersect)

# group: Fill the intersection area with a grid of points > Input
text_grid_x_spacing = DoubleInput(10)  # graph input
text_grid_y_spacing = DoubleInput(10)  # graph input

# group: Fill the intersection area with a grid of points
byGeometry = BoundingBox.ByGeometry(geom=firstItem_2)
minPoint = BoundingBox.MinPoint(boundingBox=byGeometry)
X = Point.X(point=minPoint)
maxPoint = BoundingBox.MaxPoint(boundingBox=byGeometry)
X_2 = Point.X(point=maxPoint)
range = Range(start=X, end=X_2, step=text_grid_x_spacing)
Y = Point.Y(point=minPoint)
Y_2 = Point.Y(point=maxPoint)
range_2 = Range(start=Y, end=Y_2, step=text_grid_y_spacing)
byCoordinates = Point.ByCoordinates(x=range, y=range_2, lacing=CrossProduct)
flatten_2 = List.Flatten(list=byCoordinates)
doesIntersect = Geometry.DoesIntersect(geometry=firstItem_2, other=flatten_2)
filterByBoolMask = List.FilterByBoolMask(list=flatten_2, mask=doesIntersect)

# group: Compute surface elevations at the grid points
samplePoint = Autodesk.Civil.DynamoNodes.Surface.SamplePoint(surface=select_comparison_surface, point=filterByBoolMask.in)
Z = Point.Z(point=samplePoint)
samplePoint_2 = Autodesk.Civil.DynamoNodes.Surface.SamplePoint(surface=select_base_surface, point=filterByBoolMask.in)
Z_2 = Point.Z(point=samplePoint_2)

# group: Group points based on cut (-) or fill (+)
sub = Z - Z_2
number = DoubleInput(0)
lt = sub < number
groupByKey = List.GroupByKey(list=sub, keys=lt)
groupByKey_2 = List.GroupByKey(list=filterByBoolMask.in, keys=lt)

# group: Input
number_of_digits_for_rounding = IntegerSlider(2, range=1..6 step 1)  # graph input

# group: Round cut/fill values
string_from_object = FromObject(object=groupByKey.groups)
# note: What we're doing here is figuring out the position where we want the string to end so that we get the number of digits that we want. Then we remove everything after that point.
code_block = CodeBlock(str=string_from_object, digits=number_of_digits_for_rounding) { 0; String.IndexOf(str, ".") + digits + 1; }
substring = String.Substring(string=string_from_object, startIndex=code_block.out0, length=code_block.out1)

# group: Input
text_height = DoubleInput(1)  # graph input
cut_fill_text_layer = StringInput("C-GRAD-ANNO")  # graph input

text_horizontal_mode = HorizontalMode("Center")
text_vertical_mode = VerticalMode("Middle")

# group: Create the cut/fill text
create = Autodesk.AutoCAD.DynamoNodes.DBText.Create(text=substring, insertionPoint=groupByKey_2.groups, height=text_height, horizontalMode=text_horizontal_mode, verticalMode=text_vertical_mode, layer=cut_fill_text_layer)

# note: These same colors are used for the cut/fill text that gets generated way over there ------>
list_create_2 = List.Create(item0=fill_color, item1=cut_color)

# group: Set text color
setColor = Autodesk.AutoCAD.DynamoNodes.Object.SetColor(object=create, value=list_create_2)

# group: Delete the extracted polylines
# note: Once we've brought the polyline geometry into Dynamo space, we have no further use for it. We don't want the polylines to stick around in Model Space, so we delete them.
# IMPORTANT
# Notice what is going on in the code block. This is to ensure that the polyline geometry is successfully obtained in Dynamo space BEFORE the polylines get deleted. If we don't enforce this order of operations, then we create what is called a 'race condition' where there's no guarantee that nodes will be executed in the order that we want.
code_block_2 = CodeBlock(passThrough=extractBorder, waitFor=geometry)
# ---------- code_block_2.designscript (9 lines) ----------
// This simply creates a list and then gets the first item in the list.
// It could be rewritten as:
// List.FirstItem(passThrough, waitFor);
// Or you could even simplify it further and just do:
// [a,b][0];
// This acts as a gate because Dynamo has to “collect” all of the items
// in the list before passing the contents on to the next node.

[passThrough, waitFor][0];
# ----------------------------------------
delete = Autodesk.AutoCAD.DynamoNodes.Object.Delete(object=code_block_2)

# group: Visualize the surfaces
# These nodes are for visualization only and don't affect the functionality of the rest of the graph.
triangles = Autodesk.Civil.DynamoNodes.TinSurface.Triangles(tinSurface=list_create)
transparency = IntegerSlider(30, range=0..255 step 1)
byARGB = Color.ByARGB(alpha=transparency)
byGeometryColor = Modifiers.GeometryColor.ByGeometryColor(geometry=triangles, color=byARGB)

# group: REPLACE IF POSSIBLE
# The Python node is currently broken
code_block_3 = CodeBlock()
# ---------- code_block_3.designscript (49 lines) ----------
"
import sys
import clr

clr.AddReference('ProtoGeometry')
clr.AddReference('GeometryColor')

from Autodesk.DesignScript.Geometry import *
from Modifiers import GeometryColor
from Autodesk.AutoCAD.DynamoNodes import *
from Autodesk.Civil.DynamoNodes import *

# Inputs
create_solids = IN[0]
comparison = IN[1]
base = IN[2]
layer = IN[3]
colors = IN[4]

# By default, the node will just output False if we don't want to create the solids
output = False

# If the toggle is set to true...
if create_solids:
	# Create an empty list for the output
	output = []

	# Generate the AutoCAD solids
	autocad_solids = TinSurface.CreateSolidsAtSurface(comparison, base, layer, \"\")

	# Loop through each solid
	for i in range(0, len(autocad_solids)):
		solid = autocad_solids[i]
		color = colors[i]

		# Set the color of the solid
		Object.SetColor(solid, color)

		# Get the solid's geometry in Dynamo space
		dyn_solid = solid.Geometry

		# Colorize the Dynamo solid
		colored_solid = GeometryColor.ByGeometryColor(dyn_solid, color)

		# Add the colored solid to our output
		output.append(colored_solid)

OUT = output
";
# ----------------------------------------

# group: Create solids
# note: Our goal is to only create AutoCAD solids if the toggle is set to True. This is a great example of when it's easier (and more effective) to just write a short Python script instead of creating a complicated web of nodes to try and handle this condition.
python_script_from_string = PythonStringNode(script=code_block_3, IN[0]=create_cut_fill_solids, IN[1]=select_comparison_surface, IN[2]=select_base_surface, IN[3]=solids_layer, IN[4]=list_create_2)  # CPython3
