# Dynamo graph Land_ServicePlacement.dyn (Dynamo 2.17.0.3472)
# author: Autodesk, Inc.
# Places water meter Block References offset from a lot line and creates a service line perpendicular to the water main.

current = Autodesk.AutoCAD.DynamoNodes.Document.Current()

# group: Input
block_name = StringInput("Water Meter")  # graph input

# note: This gets the source block definition that we want to create block references from.
blockByName = Autodesk.AutoCAD.DynamoNodes.Document.BlockByName(document=current, name=block_name)

# group: Input
# note: Select a Line or Polyline
select_lot_line = ObjectSelection()  # 1 picked in the model; graph input

# group: Input
water_main_layer = StringInput("C-WATR-PIPE")  # graph input

# group: Get water main as PolyCurve
current_2 = Autodesk.AutoCAD.DynamoNodes.Document.Current()
modelSpace = Autodesk.AutoCAD.DynamoNodes.Document.ModelSpace(document=current_2)
# note: This is to "select" all of the individual lines for the water main in Model Space.
all_objects_on_layer = AcObjectsOnLayer(layer=water_main_layer, block=modelSpace)
# note: Here we "convert" the AutoCAD lines to Dynamo lines so that we can work with the geometry. From this point forward, anything we do with this will only affect the Dynamo geometry - nothing happens to the original AutoCAD lines.
geometry = Autodesk.AutoCAD.DynamoNodes.Object.Geometry(object=all_objects_on_layer)
# note: We want to join all the individual lines together to create a single PolyCurve so that it's easier to work with later on.
# IMPORTANT:
# This node will attempt to join all of the input curves. If your dataset has multiple branching mainlines on the same layer, then this node may produce warnings, and a different strategy will be required.
byJoinedCurves = PolyCurve.ByJoinedCurves(curves=geometry)

# group: Prepare lot line geometry
# This group of nodes ensures that the water meters are placed on the correct end of the lot line (i.e., closest to the water main).
# note: "Convert" the lot line to Dynamo geometry.
geometry_2 = Autodesk.AutoCAD.DynamoNodes.Object.Geometry(object=select_lot_line)
# note: Get the start and end points of the lot line.
startPoint = Curve.StartPoint(curve=geometry_2)
# note: Measure the distance from those points to the water main.
distanceTo = Geometry.DistanceTo(geometry=startPoint, other=byJoinedCurves)
endPoint = Curve.EndPoint(curve=geometry_2)
distanceTo_2 = Geometry.DistanceTo(geometry=endPoint, other=byJoinedCurves)
gt = distanceTo > distanceTo_2
reverse = Curve.Reverse(curve=geometry_2)
# note: Reverse the curve if the start point is further from the water main than the end point.
if_ = RefactoredIf(test=gt, true=reverse, false=geometry_2)

# group: Input
distance_from_r_w = DoubleSlider(5, range=0.5..10 step 0.5)  # graph input
distance_from_lot_line = DoubleSlider(3, range=0.5..10 step 0.5)  # graph input

# group: Create water meter insertion points
# note: Here we create a coordinate system on the lot line at a distance from the start point. The Y axis points along the line, and the X axis is perpendicular.
coordinateSystemAtSegmentLength = Curve.CoordinateSystemAtSegmentLength(curve=if_, segmentLength=distance_from_r_w)
code_block = CodeBlock(offset=distance_from_lot_line)
# ---------- code_block.designscript (6 lines) ----------
// Create a list with positive (right)
// and negative (left) offset values.
// The two square brackets [] are what
// defines a list, and then you put whatever
// values you want inside, separate by commas.
[offset, -offset];
# ----------------------------------------
# note: Using the coordinate system, we can easily create points that are always offset perpendicular to the lot line, not matter how it is rotated!
byCartesianCoordinates = Point.ByCartesianCoordinates(coordinateSystem=coordinateSystemAtSegmentLength, x=code_block)

# group: Input
water_meter_layer = StringInput("C-WATR-METR")  # graph input

# note: We want to create our new objects (i.e., block references and lines) in Model Space, as opposed to a Paper Space layout or some other block definition.
modelSpace_2 = Autodesk.AutoCAD.DynamoNodes.Document.ModelSpace(document=current)

# group: Get service tap location on water main
# note: Here we want to get a point on the water main that is closest to the water meter location. A line between those two points will be perpendicular to the water main.
closestPointTo = Geometry.ClosestPointTo(geometry=byJoinedCurves, other=byCartesianCoordinates)

# group: Input
water_service_layer = StringInput("C-WATR-SRVC")  # graph input

# group: Create new objects
# note: Create block references at the points that we generated earlier.
create = Autodesk.AutoCAD.DynamoNodes.BlockReference.Create(sourceBlock=blockByName, position=byCartesianCoordinates, layer=water_meter_layer, block=modelSpace_2)
# note: Create a new AutoCAD line for the service connection.
byTwoPoints = Autodesk.AutoCAD.DynamoNodes.Line.ByTwoPoints(startPoint=closestPointTo, endPoint=byCartesianCoordinates, layer=water_service_layer, block=modelSpace_2)
