# Dynamo graph List-FilterByBooleanMask (1).dyn (Dynamo 0.8.1.1942)

code_block = CodeBlock { 500; }
byCoordinates = Point.ByCoordinates(x=code_block)
byOriginNormal = Plane.ByOriginNormal(origin=byCoordinates)
code_block_2 = CodeBlock { 50; }
byPlaneRadius = Circle.ByPlaneRadius(plane=byOriginNormal, radius=code_block_2)
code_block_3 = CodeBlock { 0..1..#100; }
pointAtParameter = Curve.PointAtParameter(curve=byPlaneRadius, param=code_block_3)
code_block_4 = CodeBlock { 100; }
translate = Geometry.Translate(geometry=byPlaneRadius, zTranslation=code_block_4)
pointAtParameter_2 = Curve.PointAtParameter(curve=translate, param=code_block_3)
code_block_5 = CodeBlock(list=pointAtParameter_2) { 0..List.Count(list); }
code_block_6 = CodeBlock { 4; }
mod = code_block_5 % code_block_6
code_block_7 = CodeBlock { 0; }
eq = mod == code_block_7
filterByBoolMask = List.FilterByBoolMask(list=pointAtParameter, mask=eq)
filterByBoolMask_2 = List.FilterByBoolMask(list=pointAtParameter_2, mask=eq)
byStartPointEndPoint = Line.ByStartPointEndPoint(startPoint=filterByBoolMask.in, endPoint=filterByBoolMask_2.in)
watch = Watch(eq)
