# Dynamo graph Listatlevel (1).dyn (Dynamo 1.2.0.2690)

origin = Point.Origin()
code_block = CodeBlock { 0; 4; 1; }
range = Range(start=code_block.out0, end=code_block.out1, step=code_block.out2, lacing=Longest)
x_vector_bycoordinates = Vector.ByCoordinates(x=range, y=code_block.out0, z=code_block.out0)
translate = Geometry.Translate(geometry=origin, direction=x_vector_bycoordinates, lacing=Longest)
y_vector_bycoordinates = Vector.ByCoordinates(x=code_block.out0, y=range, z=code_block.out0)
translate_2 = Geometry.Translate(geometry=translate, direction=y_vector_bycoordinates, lacing=CrossProduct)
z_vector_bycoordinates = Vector.ByCoordinates(x=code_block.out0, y=code_block.out0, z=range)
translate_3 = Geometry.Translate(geometry=translate_2, direction=z_vector_bycoordinates, lacing=CrossProduct)

# group: List@Level Method
code_block_2 = CodeBlock { 0; }
getItemAtIndex = List.GetItemAtIndex(list=translate_3@L3, index=code_block_2)

# group: List.Map Methods
code_block_3 = CodeBlock { 0; }
getItemAtIndex_2 = List.GetItemAtIndex(index=code_block_3)  # unwired: list
map = List.Map(f_x=getItemAtIndex_2)  # unwired: list
getItemAtIndex_3 = List.GetItemAtIndex(index=code_block_3)  # unwired: list

# group: @L2
map_2 = List.Map(list=translate_3, f_x=map)

# group: @L3
map_3 = List.Map(list=translate_3, f_x=getItemAtIndex_3)

# group: @L4
getItemAtIndex_4 = List.GetItemAtIndex(list=translate_3, index=code_block_3)
