# Dynamo graph Map (1).dyn (Dynamo 0.8.1.1942)

integer_slider = IntegerSlider(5, range=-50..50 step 1)
integer_slider_2 = IntegerSlider(3, range=-50..50 step 1)
code_block = CodeBlock(Nx=integer_slider, Ny=integer_slider_2) { -50..50..#Nx; -50..50..#Ny; }
byCoordinates = Point.ByCoordinates(x=code_block.out0, y=code_block.out1, lacing=CrossProduct)
watch = Watch(byCoordinates)
count = List.Count(watch)
watch_2 = Watch(count)
count_2 = List.Count()
map = List.Map(list=watch, f_x=count_2)
watch_3 = Watch(map)
