# Dynamo graph PlanProduction_NotePlacement.dyn (Dynamo 2.18.0.4931)
# author: Autodesk, Inc.
# Labels block references in an Xref with multileaders that are populated with block attribute data.

# group: Input
# note: The name of the Xref containing the block references to be labeled.
xref_name = StringInput("PlanProduction_Proposed")  # graph input
# note: The name of the block reference (in the Xref) to be labeled.
block_name = StringInput("SIGN")  # graph input
# note: The name of the block attribute to pull information from and place in the MLeader text content.
block_attribute = StringInput("CODE")  # graph input
mleader_layer = StringInput("G-ANNO-NOTE")  # graph input

# group: Get the Xref
current = Autodesk.AutoCAD.DynamoNodes.Document.Current()
blockByName = Autodesk.AutoCAD.DynamoNodes.Document.BlockByName(document=current, name=xref_name)

# group: Filter to leave only block references
objects = Autodesk.AutoCAD.DynamoNodes.Block.Objects(block=blockByName)
string = StringInput("BlockReference")
removeIfNot = List.RemoveIfNot(list=objects, type=string)

# group: Get the block reference names
block = Autodesk.AutoCAD.DynamoNodes.BlockReference.Block(blockReference=removeIfNot)
name = Autodesk.AutoCAD.DynamoNodes.Block.Name(block=block)
string_2 = StringInput("|")
# note: Blocks that are within an Xref will follow the pattern <Xref name>|<Block name>. So we can split the names at the pipe symbol ( | ) to get the block name as it shows up in the Xref file itself.
split = String.Split(string=name, separator0=string_2)
lastItem = List.LastItem(list=split@L2)

# group: Filter block references to leave those with the specified name
eq = lastItem == block_name
filterByBoolMask = List.FilterByBoolMask(list=removeIfNot, mask=eq)

# group: Get the attribute values
attributeByTag = Autodesk.AutoCAD.DynamoNodes.BlockReference.AttributeByTag(blockReference=filterByBoolMask.in, tag=block_attribute)

# group: Input
text_offset_x = DoubleSlider(10, range=1..100 step 1)  # graph input
text_offset_y = DoubleSlider(15, range=1..100 step 1)  # graph input
mleader_scale = DoubleInput(20)  # graph input

# group: Define MLeader dragged offset
# note: It may be confusing why we need to work with vectors here. Why can't we just specify an X and Y offset? Well, instead of thinking of a vector as some type of abstract geometry, just think of it as a convenient way to package up X, Y, and Z coordinates into a single "value."
byCoordinates = Vector.ByCoordinates(x=text_offset_x, y=text_offset_y)

# group: Create MLeaders
byObjectText = Autodesk.AutoCAD.DynamoNodes.MLeader.ByObjectText(obj=filterByBoolMask.in, text=attributeByTag, displacement=byCoordinates, layer=mleader_layer)

# group: Set MLeader scale
setScale = Autodesk.AutoCAD.DynamoNodes.MLeader.SetScale(mLeader=byObjectText, value=mleader_scale)
