# Dynamo graph PlanProduction_SheetQuantities.dyn (Dynamo 2.18.0.4931)
# author: Autodesk, Inc.
# Creates a table in each sheet with a quantity summary for block references grouped by their attribute values.

# group: Input
table_insertion_point_x = DoubleSlider(29.2, range=0..34 step 0.1)  # graph input
table_insertion_point_y = DoubleSlider(19.3, range=0..22 step 0.1)  # graph input
table_column_width = DoubleInput(1.1)  # graph input
table_text_height = DoubleInput(0.1)  # graph input
table_cell_alignment = CellAlignmentDropDown("Middle Center")  # graph input
table_layer = StringInput("G-ANNO-TABL")  # graph input

# note: This is the insertion point for the table in paper space coordinates. The table insertion point is at the upper-left corner of the table.
byCoordinates = Point.ByCoordinates(x=table_insertion_point_x, y=table_insertion_point_y)

# group: Input
# note: The name of the Xref containing the block references to be quantified.
xref_name = StringInput("PlanProduction_Proposed")  # graph input
# note: The name of the block reference (in the Xref) whose attributes will be collected.
block_name = StringInput("SIGN")  # graph input

# group: Get the Xref
current = Autodesk.AutoCAD.DynamoNodes.Document.Current()
blockByName = Autodesk.AutoCAD.DynamoNodes.Document.BlockByName(document=current, name=xref_name)

# group: Filter to leave only block references
objects = Autodesk.AutoCAD.DynamoNodes.Block.Objects(block=blockByName)
string = StringInput("BlockReference")
removeIfNot = List.RemoveIfNot(list=objects, type=string)

# group: Get the block reference names
block = Autodesk.AutoCAD.DynamoNodes.BlockReference.Block(blockReference=removeIfNot)
name = Autodesk.AutoCAD.DynamoNodes.Block.Name(block=block)
string_2 = StringInput("|")
# note: Blocks that are within an Xref will follow the pattern <Xref name>|<Block name>. So we can split the names at the pipe symbol ( | ) to get the block name as it shows up in the Xref file itself.
split = String.Split(string=name, separator0=string_2)
lastItem = List.LastItem(list=split@L2)

# group: Filter block references to leave those with the specified name
eq = lastItem == block_name
filterByBoolMask = List.FilterByBoolMask(list=removeIfNot, mask=eq)

# group: Get layouts (excluding Model tab)
current_2 = Autodesk.AutoCAD.DynamoNodes.Document.Current()
# note: This will return all of the layout tabs in the document, including the "Model" tab. We only want to work with the paper space layouts, so we need to filter out the Model tab.
layouts = Autodesk.AutoCAD.DynamoNodes.Document.Layouts(document=current_2)
layoutName = Autodesk.AutoCAD.DynamoNodes.Layout.LayoutName(layout=layouts)
string_3 = StringInput("Model")
eq_2 = layoutName == string_3
filterByBoolMask_2 = List.FilterByBoolMask(list=layouts, mask=eq_2)

# group: Get viewports
getViewports = Autodesk.AutoCAD.DynamoNodes.Layout.GetViewports(layout=filterByBoolMask_2.out, layout_2=filterByBoolMask_2.out)

# group: REPLACE WHEN BUG IS FIXED
# Layout.GetViewports returns an extra viewport
customScale = Autodesk.AutoCAD.DynamoNodes.Viewport.CustomScale(viewport=getViewports)
code_block = CodeBlock { 1; }
eq_3 = customScale == code_block
filterByBoolMask_3 = List.FilterByBoolMask(list=getViewports, mask=eq_3)

# group (continued): Get viewports
# note: IMPORTANT
# In this example there is only one viewport per sheet, so it's safe for us to just get the first item in the list. But in other cases, a sheet may have multiple viewports, which means that this part of the graph will need to be augmented with logic to determine the specific viewport to work with.
firstItem = List.FirstItem(list=filterByBoolMask_3.out@L2)

# group: Transform viewport boundary to model space coordinates
boundary = Autodesk.AutoCAD.DynamoNodes.Viewport.Boundary(viewport=firstItem)
# note: This node basically provides us with the "conversion factors" to be able to translate/rotate objects for paper space coordinates to model space coordinates.
paperToModelCS = Autodesk.AutoCAD.DynamoNodes.Viewport.PaperToModelCS(viewport=firstItem)
transform = Geometry.Transform(geometry=boundary, cs=paperToModelCS)
XYPlane = CoordinateSystem.XYPlane(coordinateSystem=paperToModelCS)
customScale_2 = Autodesk.AutoCAD.DynamoNodes.Viewport.CustomScale(viewport=firstItem)
code_block_2 = CodeBlock(scale=customScale_2) { 1/scale; }
# note: The viewport will be transformed to model coordinates, but then it needs to be scaled by the viewport scale.
scale = Geometry.Scale(geometry=transform, plane=XYPlane, xamount=code_block_2, yamount=code_block_2, zamount=code_block_2)

# group: Create a surface in Dynamo space that we can intersect with
# note: Our ultimate goal is to figure out which block references show up in each viewport. To do this, we're going to need the points for each block reference and then some way to figure out if those points are contained within a viewport boundary. This surface will enable us to do that.
byPatch = Surface.ByPatch(closedCurve=scale)

# group: Figure out which block references are shown in each viewport
# note: What we're doing here is getting the insertion point of each block reference and then testing each point to see if it intersects (i.e., is contained within) each viewport. Then we filter the list of block references so that we're left with only those that are shown in each viewport.
position = Autodesk.AutoCAD.DynamoNodes.BlockReference.Position(blockReference=filterByBoolMask.in)
doesIntersect = Geometry.DoesIntersect(geometry=byPatch@L1, other=position)
filterByBoolMask_4 = List.FilterByBoolMask(list=filterByBoolMask.in, mask=doesIntersect@L2)

# group: Input
# note: The name of the block attribute to pull information from and summarize in the table.
block_attribute = StringInput("CODE")  # graph input

# group: Group the block references by their attribute values and count the occurences of each unique value
# note: Get the attribute values.
attributeByTag = Autodesk.AutoCAD.DynamoNodes.BlockReference.AttributeByTag(blockReference=filterByBoolMask_4.in, tag=block_attribute)
# note: Group the block references (in each viewport) by their attribute values.
groupByKey = List.GroupByKey(list=filterByBoolMask_4.in@L2, keys=attributeByTag@L2)
# note: Count the number of occurences of each unique attribute value.
count = List.Count(list=groupByKey.groups@@L2)

# group: Organize data for table output
code_block_3 = CodeBlock()
# ---------- code_block_3.designscript (2 lines) ----------
// These are the column headers
["Sign Code","Quantity"];
# ----------------------------------------
list_create = List.Create(item0=groupByKey.uniqueKeys, item1=count)
transpose = List.Transpose(lists=list_create)
transpose_2 = List.Transpose(lists=transpose, lacing=Shortest)
addItemToFront = List.AddItemToFront(item=code_block_3, list=transpose_2@L3)

# group: Get the paper space block
# note: Each paper space layout is actually a block, which means that it has a coordinate system and can contain objects. This is what enables us to place different tables in each sheet (see right --->).
block_2 = Autodesk.AutoCAD.DynamoNodes.Layout.Block(layout=filterByBoolMask_2.out)

# group: Create the tables
byPointData = Autodesk.AutoCAD.DynamoNodes.Table.ByPointData(point=byCoordinates, data=addItemToFront, columnWidth=table_column_width, textHeight=table_text_height, cellAlignment=table_cell_alignment, layer=table_layer, block=block_2)
