# Dynamo graph Python_Catchments.dyn (Dynamo 2.18.1.5096)

# group: Input
string = StringInput("C-HYDR-CTCH")

# group: Get all of the Catchments
current = Autodesk.AutoCAD.DynamoNodes.Document.Current()
modelSpace = Autodesk.AutoCAD.DynamoNodes.Document.ModelSpace(document=current)
all_objects_on_layer = AcObjectsOnLayer(layer=string, block=modelSpace)

# group: Get the Catchment boundary points
python_script = Python(IN[0]=all_objects_on_layer)  # CPython3
# ---------- python_script.python (63 lines) ----------
# Load the Python Standard and DesignScript Libraries
import sys
import clr

# Add Assemblies for AutoCAD and Civil3D
clr.AddReference('AcMgd')
clr.AddReference('AcCoreMgd')
clr.AddReference('AcDbMgd')
clr.AddReference('AecBaseMgd')
clr.AddReference('AecPropDataMgd')
clr.AddReference('AeccDbMgd')

clr.AddReference('ProtoGeometry')

# Import references from AutoCAD
from Autodesk.AutoCAD.Runtime import *
from Autodesk.AutoCAD.ApplicationServices import *
from Autodesk.AutoCAD.EditorInput import *
from Autodesk.AutoCAD.DatabaseServices import *
from Autodesk.AutoCAD.Geometry import *

# Import references from Civil3D
from Autodesk.Civil.ApplicationServices import *
from Autodesk.Civil.DatabaseServices import *

from Autodesk.DesignScript.Geometry import Point as DynPoint

# The inputs to this node will be stored as a list in the IN variables.
objs = IN[0]

output = []

if objs is None:
    sys.exit("The input is null or empty.")

if not isinstance(objs, list):
    objs = [objs]
    
adoc = Application.DocumentManager.MdiActiveDocument
editor = adoc.Editor

with adoc.LockDocument():
    with adoc.Database as db:
        
        with db.TransactionManager.StartTransaction() as t:
            for obj in objs:              
                id = obj.InternalObjectId
                aeccObj = t.GetObject(id, OpenMode.ForRead)                
                if isinstance(aeccObj, Catchment):
                    catchment = aeccObj
                    acPnts = catchment.BoundaryPolyline3d                    
                    dynPnts = []
                    for acPnt in acPnts:
                        pnt = DynPoint.ByCoordinates(acPnt.X, acPnt.Y, acPnt.Z)
                        dynPnts.append(pnt)
                    output.append(dynPnts)
            
            # Commit before end transaction
            t.Commit()
            pass
            
# Assign your output to the OUT variable.
OUT = output
# ----------------------------------------

# group: Create PolyCurves from the boundary points
byPoints = PolyCurve.ByPoints(points=python_script)
