# Dynamo graph Python_Custom-Node (1).dyn "Python-CustomNode" (Dynamo 2.8.0.2182)

create = List.Create()  # unwired: item0, item1
code_block = CodeBlock { 100; }
byWidthLength = Rectangle.ByWidthLength(width=code_block, length=code_block)
byPatch = Surface.ByPatch(closedCurve=byWidthLength)
code_block_2 = CodeBlock { 5; }
translate = Geometry.Translate(geometry=byWidthLength, zTranslation=code_block_2)
points = Polygon.Points(polygon=translate)
code_block_3 = CodeBlock { [0,30,0,0]; }
translate_2 = Geometry.Translate(geometry=points, zTranslation=code_block_3)
byPoints = Polygon.ByPoints(points=translate_2)
create_2 = List.Create(item0=byWidthLength, item1=byPoints)
byLoft = Surface.ByLoft(crossSections=create_2)
byPatch_2 = Surface.ByPatch(closedCurve=byPoints)
create_3 = List.Create(item0=byPatch, item1=byLoft, item2=byPatch_2)
byJoinedSurfaces = Solid.ByJoinedSurfaces(facesOfSolid=create_3)
code_block_4 = CodeBlock { 3; }
code_block_5 = CodeBlock { 10; }
python_script = Python(IN[0]=byJoinedSurfaces, IN[1]=code_block_4, IN[2]=code_block_5, IN[3]=code_block_5)  # IronPython2
# ---------- python_script.python (38 lines) ----------
import clr
clr.AddReference('ProtoGeometry')
from Autodesk.DesignScript.Geometry import *
#The inputs to this node will be stored as a list in the IN variables.
solid = IN[0]
seed = IN[1]
xCount = IN[2]
yCount = IN[3]

solids = []
crvs = []

edges = solid.Edges
for edge in edges:
	crvs.append(edge.CurveGeometry)
	
bbox = BoundingBox.ByGeometry(crvs)
yDist = bbox.MaxPoint.Y-bbox.MinPoint.Y
xDist = bbox.MaxPoint.X-bbox.MinPoint.X

xRange = list(range(xCount))
yRange = list(range(yCount))

fromCoord = solid.ContextCoordinateSystem
 
#Loop through X and Y
for i in xRange:
	for j in yRange:
		#Rotate and translate the coordinate system
		toCoord = fromCoord.Rotate(solid.ContextCoordinateSystem.Origin,Vector.ByCoordinates(0,0,1),(90*(i+j%seed)))
		vec = Vector.ByCoordinates((xDist*i),(yDist*j),0)
		toCoord = toCoord.Translate(vec)
		#Transform the solid from the source coordinate system to the target coordinate system and append to the list
		solids.append(solid.Transform(fromCoord,toCoord))


#Assign your output to the OUT variable.
OUT = solids
# ----------------------------------------
edges = Topology.Edges(topology=python_script)
curveGeometry = Edge.CurveGeometry(edge=edges)
