# Dynamo graph Rail_ClearanceEnvelope (1).dyn "Rail_ClearanceEnvelope" (Dynamo 2.17.0.3472)
# author: Autodesk, Inc.
# Uses a vehicle profile to generate a 3D solid clearance envelope along a Corridor.

# group: Input
corridor_name = StringInput("Corridor - (1)")  # graph input
baseline_name = StringInput("BL - Alignment - (1) - (1)")  # graph input
# note: The point code for the Corridor Feature Line that the envelope should follow.
point_code = StringInput("CL_Track")  # graph input

# group: Get the corridor data
current = Autodesk.AutoCAD.DynamoNodes.Document.Current()
# note: First, we get the Corridor that we want to work with.
corridorByName = Autodesk.Civil.DynamoNodes.Selection.CorridorByName(name=corridor_name, document=current)
# note: Next, we get the specific baseline within the Corridor.
baselineByName = Autodesk.Civil.DynamoNodes.Corridor.BaselineByName(corridor=corridorByName, name=baseline_name)
# note: Here we get the Corridor feature line defined by the point code that we input before.
corridorFeatureLinesByCode = Autodesk.Civil.DynamoNodes.Baseline.CorridorFeatureLinesByCode(baseline=baselineByName, code=point_code)

# group: Visualize the corridor
# These nodes are just here to provide some context in Dynamo and have no effect on the rest of the graph's functionality.
corridorFeatureLines = Autodesk.Civil.DynamoNodes.Baseline.CorridorFeatureLines(baseline=baselineByName)
polyCurve = Autodesk.Civil.DynamoNodes.CorridorFeatureLine.PolyCurve(corridorFeatureLine=corridorFeatureLines)
transparency = DoubleSlider(40, range=0..255 step 1)
byARGB = Color.ByARGB(alpha=transparency)
byGeometryColor = Modifiers.GeometryColor.ByGeometryColor(geometry=polyCurve, color=byARGB)

# group: Input
profile_block_name = StringInput("ClearanceProfile")  # graph input
start_station = DoubleInput(600)  # graph input
end_station = DoubleInput(1500)  # graph input
# note: The distance between the profiles used to define the envelope solid.
profile_spacing = DoubleInput(25)  # graph input

# group: Get the profile block
current_2 = Autodesk.AutoCAD.DynamoNodes.Document.Current()
# note: Note that this is the block definition, not a block reference.
blockByName = Autodesk.AutoCAD.DynamoNodes.Document.BlockByName(document=current_2, name=profile_block_name)

# group: Get the block geometry
# note: This gets all of the objects within the block definition.
objects = Autodesk.AutoCAD.DynamoNodes.Block.Objects(block=blockByName)
# note: IMPORTANT:
# This graph was designed to work with a very simple block that only contains a Polyline outline of the vehicle profile. If the block that you choose to use contains other objects such as Text, Attributes, etc., then this node may give warnings.
geometry = Autodesk.AutoCAD.DynamoNodes.Object.Geometry(object=objects)

# group: Create coordinate systems along corridor feature line
# note: This simply generates a sequence of numbers.
range = Range(start=start_station, end=end_station, step=profile_spacing)
# note: What this ultimately means is that the geometry that we get from the profile block will be oriented perpendicular to the Corridor instead of purely vertical. This is a closer model of reality because rail cars are always perpendicular to the tracks.
boolean = BoolSelector(false)
# note: This creates coordinate systems along the Corridor feature line that match the position and rotation of the Corridor at the particular station. What is a coordinate system? It's simple an origin point with X, Y, and Z axes. Take a look at the Dynamo Primer for a more in-depth explanation.
# Note the 'XXX' in the bottom-right corner of the node. This means that the lacing settings for the node is set to "Cross product," which ensures that we generate coordinate systems at each station for both Corridor feature lines (left and right).
coordinateSystemByStation = Autodesk.Civil.DynamoNodes.CorridorFeatureLine.CoordinateSystemByStation(corridorFeatureLine=corridorFeatureLinesByCode, station=range, vertical=boolean, lacing=CrossProduct)

# group: Transform the block geometry to the coordinate system locations
# This is the trickiest part of the whole graph. Check the node outputs and the background preview to help understand!
# note: What we're doing with these nodes is translating and rotating the block geometry to align with the coordinate systems along the Corridor. In essence, we are "transforming" the geometry from one coordinate system to another.
# note: First, we get a standard coordinate system with the origin at (0, 0, 0) and canonical X, Y, and Z axes. The block geometry is located relative to this coordinate system because that is what is being used when you define a block in the block editor.
identity = CoordinateSystem.Identity()
origin = CoordinateSystem.Origin(coordinateSystem=identity)
XAxis = CoordinateSystem.XAxis(coordinateSystem=identity)
number = DoubleInput(-90)
# note: The geometry in the block is parallel with the XY plane (as most linework is). However, we want to rotate that geometry so that the XY plane becomes vertical relative to the coordinate systems along the Corridor.
rotate = CoordinateSystem.Rotate(coordinateSystem=identity, origin=origin, axis=XAxis, degrees=number)
# note: Finally, we transform the geometry from our source coordinate system to the destination coordinate systems. Note the three little bars in the bottom-right corner of the node. This means that the node lacing is set to "longest," which ensures that we transform the block geometry (single object) to all of the coordinate systems (multiple).
transform = Geometry.Transform(geometry=geometry, fromCoordinateSystem=rotate, contextCoordinateSystem=coordinateSystemByStation, lacing=Longest)

# group: Generate the solids
# note: "Lofting" is a method of generating solid geometry between multiple cross sections.
byLoft = Solid.ByLoft(crossSections=transform)

# group: Input
color_palette = ColorPalette({R: 218, G: 112, B: 214, A: 255})
layer_for_solids = StringInput("C-RAIL-VEHICLE")  # graph input

# group: Visualize the solids in Dynamo
# note: This colors the Dynamo solids.
byGeometryColor_2 = Modifiers.GeometryColor.ByGeometryColor(geometry=byLoft, color=color_palette)

# group: Create the solids in Civil 3D
current_3 = Autodesk.AutoCAD.DynamoNodes.Document.Current()
modelSpace = Autodesk.AutoCAD.DynamoNodes.Document.ModelSpace(document=current_3)
# note: Previously we created the solids in Dynamo space. Now we need to actually create the AutoCAD solids in Model Space.
byGeometry = Autodesk.AutoCAD.DynamoNodes.Object.ByGeometry(geometry=byLoft, layer=layer_for_solids, block=modelSpace)

# group: Set the color of the solids
# note: This colors the AutoCAD solids.
setColor = Autodesk.AutoCAD.DynamoNodes.Object.SetColor(object=byGeometry, color=color_palette)
