# Dynamo graph Rail_PlaceTies.dyn (Dynamo 2.18.0.4931)
# author: Autodesk, Inc.
# Places railroad tie block references along a corridor at a specified spacing. The ties are rotated according to the alignment cant.

# group: Input
corridor_name = StringInput("Rail")  # graph input
tie_block_name = StringInput("CONC_TIE")  # graph input
baseline_name = StringInput("BL - Rail Centerline - (1)")  # graph input
# note: The assembly point code that defines where the ties should be placed.
point_code = StringInput("CL_Track")  # graph input
tie_spacing = DoubleInput(2)  # graph input
tie_layer = StringInput("C-RAIL-TIES")  # graph input

# group: Get the corridor
current = Autodesk.AutoCAD.DynamoNodes.Document.Current()
corridorByName = Autodesk.Civil.DynamoNodes.Selection.CorridorByName(name=corridor_name, document=current)

# group: Visualize the corridor
# This doesn't affect the rest of the graph, it's just to help provide context.
baselines = Autodesk.Civil.DynamoNodes.Corridor.Baselines(corridor=corridorByName)
codes = Autodesk.Civil.DynamoNodes.Baseline.Codes(baseline=baselines)
corridorFeatureLinesByCode = Autodesk.Civil.DynamoNodes.Baseline.CorridorFeatureLinesByCode(baseline=baselines, code=codes.Point_Codes)
polyCurve = Autodesk.Civil.DynamoNodes.CorridorFeatureLine.PolyCurve(corridorFeatureLine=corridorFeatureLinesByCode)
color_palette = ColorPalette({R: 200, G: 200, B: 200, A: 255})
byGeometryColor = Modifiers.GeometryColor.ByGeometryColor(geometry=polyCurve, color=color_palette)

# group: Get tie block definition
current_2 = Autodesk.AutoCAD.DynamoNodes.Document.Current()
blockByName = Autodesk.AutoCAD.DynamoNodes.Document.BlockByName(document=current_2, name=tie_block_name)

# group: Get corridor baseline info
baselineByName = Autodesk.Civil.DynamoNodes.Corridor.BaselineByName(corridor=corridorByName, name=baseline_name)
corridorFeatureLinesByCode_2 = Autodesk.Civil.DynamoNodes.Baseline.CorridorFeatureLinesByCode(baseline=baselineByName, code=point_code)
alignment = Autodesk.Civil.DynamoNodes.Baseline.Alignment(baseline=baselineByName)

# group: Compute stations for placing ties
startStation = Autodesk.Civil.DynamoNodes.CorridorFeatureLine.StartStation(corridorFeatureLine=corridorFeatureLinesByCode_2)
endStation = Autodesk.Civil.DynamoNodes.CorridorFeatureLine.EndStation(corridorFeatureLine=corridorFeatureLinesByCode_2)
# note: Here we are creating a list of station values at the specified increment, beginning at the feature line start station and going to the end. If you have a specific start or end station, you could input them here. Just make sure the values are within the valid range for the feature line!
range = Range(start=startStation, end=endStation, step=tie_spacing)

# group: Create coordinate systems that define insertion point/scale/rotation
# note: A coordinate system is a bit of a tricky concept at first. Take a look at the results in the Dynamo background preview to see the results, and also refer to the Dynamo Primer for more info.
coordinateSystemByStation = Autodesk.Civil.DynamoNodes.CorridorFeatureLine.CoordinateSystemByStation(corridorFeatureLine=corridorFeatureLinesByCode_2, station=range)
# note: What we're doing here is rotating the coordinate systems to match the cant rotation before we use them to place the ties.
ZXPlane = CoordinateSystem.ZXPlane(coordinateSystem=coordinateSystemByStation)
# note: This gives us the calculated cant values for the alignment at the stations where we want to put the ties.
getCantInfoAtStation = Autodesk.Civil.DynamoNodes.Alignment.GetCantInfoAtStation(alignment=alignment, station=range)
# note: IMPORTANT
# Note that this graph is built with the assumption that a center baseline pivot point is used for calculating the cant. The math will need to be adjusted if a different condition is used!
code_block = CodeBlock(diffRight=getCantInfoAtStation.RightRailElevationDifference, width=getCantInfoAtStation.TrackWidth)
# ---------- code_block.designscript (3 lines) ----------
// This calculates the rotation
// angle produced by the cant.
-Math.Asin(diffRight / (width/2));
# ----------------------------------------
rotate = CoordinateSystem.Rotate(coordinateSystem=coordinateSystemByStation, plane=ZXPlane, degrees=code_block)

# group: Create block references
byCoordinateSystem = Autodesk.AutoCAD.DynamoNodes.BlockReference.ByCoordinateSystem(sourceBlock=blockByName, coordinateSystem=rotate, layer=tie_layer)

# group: Output result to Dynamo Player
flatten = List.Flatten(list=byCoordinateSystem)
# note: If you right-click on this node, you'll see that "Is Output" is checked, which means that the results of this node will display in Dynamo Player after the graph finished running.
no_of_ties_placed = List.Count(list=flatten)  # graph output
