# Dynamo graph ReplaceItems.dyn (Dynamo 2.0.0.4654)

code_block = CodeBlock { 100; }
byWidthLength = Rectangle.ByWidthLength(width=code_block, length=code_block)
byPatch = Surface.ByPatch(closedCurve=byWidthLength)
code_block_2 = CodeBlock { 0..1..#3; 0..1..#5; }
pointAtParameter = Surface.PointAtParameter(surface=byPatch, u=code_block_2.out0, v=code_block_2.out1, lacing=CrossProduct)
code_block_3 = CodeBlock { 1; }
code_block_4 = CodeBlock { 1; }
getItemAtIndex = List.GetItemAtIndex(list=pointAtParameter, index=code_block_4)
code_block_5 = CodeBlock { 2; }
code_block_6 = CodeBlock(points=pointAtParameter) { points[1][2]; }
code_block_7 = CodeBlock { 20; }
translate = Geometry.Translate(geometry=code_block_6, zTranslation=code_block_7)
replaceItemAtIndex = List.ReplaceItemAtIndex(list=getItemAtIndex, index=code_block_5, item=translate)
replaceItemAtIndex_2 = List.ReplaceItemAtIndex(list=pointAtParameter, index=code_block_3, item=replaceItemAtIndex)
byPoints = NurbsCurve.ByPoints(points=replaceItemAtIndex_2)
byLoft = Surface.ByLoft(crossSections=byPoints)
