# Dynamo graph Revit-Doc.dyn (Dynamo 0.8.3.2256)

python_script = Python()
# ---------- python_script.python (17 lines) ----------
import clr
clr.AddReference('ProtoGeometry')
from Autodesk.DesignScript.Geometry import *
#The inputs to this node will be stored as a list in the IN variables.
import clr

# Import DocumentManager
clr.AddReference("RevitServices")
import RevitServices
from RevitServices.Persistence import DocumentManager

doc = DocumentManager.Instance.CurrentDBDocument
uiapp = DocumentManager.Instance.CurrentUIApplication
app = uiapp.Application

#Assign your output to the OUT variable.
OUT=[doc,uiapp,app]
# ----------------------------------------
watch = Watch(python_script)
