# Dynamo graph Revit-ReferenceCurve (1).dyn (Dynamo 0.8.3.2256)

code_block = CodeBlock { 0; }
byCoordinates = ReferencePoint.ByCoordinates(x=code_block, y=code_block, z=code_block)
number_slider = DoubleSlider(3.3, range=0..10 step 0.1)
number_slider_2 = DoubleSlider(2.9, range=0..10 step 0.1)
number_slider_3 = DoubleSlider(2.6, range=0..10 step 0.1)
byCoordinates_2 = ReferencePoint.ByCoordinates(x=number_slider, y=number_slider_2, z=number_slider_3)
python_script = Python(IN[0]=byCoordinates, IN[1]=byCoordinates_2)
# ---------- python_script.python (17 lines) ----------
import clr

# Import RevitNodes
clr.AddReference("RevitNodes")
import Revit
# Import Revit elements
from Revit.Elements import *
import System

#define inputs
startRefPt = IN[0]
endRefPt = IN[1]

#define system array to match with required inputs
refPtArray = System.Array[ReferencePoint]([startRefPt, endRefPt])
#create curve by reference points in Revit
OUT = CurveByPoints.ByReferencePoints(refPtArray)
# ----------------------------------------
