# Dynamo graph Roads_CorridorBlockRefs (1).dyn "Roads_CorridorBlockRefs" (Dynamo 2.15.1.6076)
# author: Autodesk, Inc.
# Places Block References along a Corridor at stations defined in an Excel file.

# group: Input
excel_file_path = Filename(".\LightPoles.xlsx")  # graph input
sheet_name = StringInput("LightPoles")  # graph input

# group: Import Excel data
# note: It is recommend to use this node instead of the Data.ImportExcel node because it provides more consistent behavior.
openXMLImportExcel = Data.OpenXMLImportExcel(filePath=excel_file_path, sheetName=sheet_name)

# group: Create dictionary from Excel data
# This group of nodes are a great example that you can re-use when working with other Excel datasets. Putting the data into a dictionary gives you the flexibility to change the order of the columns in Excel without breaking the Dynamo graph.
# note: We're assuming here that the first row of data that we get from Excel will be column headers, which we can use as the 'keys' in the dictionary.
firstItem = List.FirstItem(list=openXMLImportExcel)
number = DoubleInput(1)
# note: Here we want to separate the column headers from the rest of the data. So we simply remove the first item from the list.
dropItems = List.DropItems(list=openXMLImportExcel, amount=number)
transpose = List.Transpose(lists=dropItems)
# note: A dictionary is simply a set of key-value pairs, just like how you would look up a word (key) in a language dictionary to gets its definition (value). Check out the Dynamo Primer online for more information.
byKeysValues = DesignScript.Builtin.Dictionary.ByKeysValues(keys=firstItem, values=transpose)

# group: Excel column headers
string = StringInput("BlockName")
string_2 = StringInput("Corridor")
string_3 = StringInput("Baseline")
string_4 = StringInput("PointCode")
string_5 = StringInput("Station")
string_6 = StringInput("Layer")

# group: Get column values
valueAtKey = DesignScript.Builtin.Dictionary.ValueAtKey(dictionary=byKeysValues, key=string)
valueAtKey_2 = DesignScript.Builtin.Dictionary.ValueAtKey(dictionary=byKeysValues, key=string_2)
valueAtKey_3 = DesignScript.Builtin.Dictionary.ValueAtKey(dictionary=byKeysValues, key=string_3)
valueAtKey_4 = DesignScript.Builtin.Dictionary.ValueAtKey(dictionary=byKeysValues, key=string_4)
valueAtKey_5 = DesignScript.Builtin.Dictionary.ValueAtKey(dictionary=byKeysValues, key=string_5)
valueAtKey_6 = DesignScript.Builtin.Dictionary.ValueAtKey(dictionary=byKeysValues, key=string_6)

# group: Get the block definitions
current = Autodesk.AutoCAD.DynamoNodes.Document.Current()
blockByName = Autodesk.AutoCAD.DynamoNodes.Document.BlockByName(document=current, name=valueAtKey)

# group: Get the corridor feature lines
# These nodes are getting the corridors, baselines, and feature lines within them using the values that we defined in the Excel file.
current_2 = Autodesk.AutoCAD.DynamoNodes.Document.Current()
corridorByName = Autodesk.Civil.DynamoNodes.Selection.CorridorByName(name=valueAtKey_2, document=current_2)
baselineByName = Autodesk.Civil.DynamoNodes.Corridor.BaselineByName(corridor=corridorByName, name=valueAtKey_3)
corridorFeatureLinesByCode = Autodesk.Civil.DynamoNodes.Baseline.CorridorFeatureLinesByCode(baseline=baselineByName, code=valueAtKey_4)

# group: Input
align_block_references = BoolSelector(true)  # "Align Block References Vertically?"; graph input

# group: Get coordinate systems along corridor feature line
# note: Here we are getting the offset and elevation of the corridor feature line at each station. We'll use the offset value to figure out if we need to rotate the block references or not.
offsetElevationByStation = Autodesk.Civil.DynamoNodes.CorridorFeatureLine.OffsetElevationByStation(corridorFeatureLine=corridorFeatureLinesByCode, station=valueAtKey_5)
# note: This gives us coordinate systems along the corridor feature line at the stations where we want to place the block references. A coordinate system is kind of an abstract concept, but it's basically just an origin point with an X, Y, and Z axis. You can read more about this on the Primer, and use the background preview in Dynamo to see what the coordinate systems look like.
coordinateSystemByStation = Autodesk.Civil.DynamoNodes.CorridorFeatureLine.CoordinateSystemByStation(corridorFeatureLine=corridorFeatureLinesByCode, station=valueAtKey_5, vertical=align_block_references)
# note: This may look a little confusing, but the goal is simple. If the corridor feature line is right of the baseline (i.e., positive offset), then we want to rotate the coordinate system by 180 degrees. Otherwise we don't rotate. The syntax that you see here follows this pattern:
# (condition) ? (do this if true) : (do this if false)
code_block = CodeBlock(offset=offsetElevationByStation.Offset, cs=coordinateSystemByStation)
# ---------- code_block.designscript (6 lines) ----------
offset > 0
	? CoordinateSystem.Rotate(
		cs,
		CoordinateSystem.XYPlane(cs),
		180)
	: cs;
# ----------------------------------------

# group: Create the block references
current_3 = Autodesk.AutoCAD.DynamoNodes.Document.Current()
modelSpace = Autodesk.AutoCAD.DynamoNodes.Document.ModelSpace(document=current_3)
byCoordinateSystem = Autodesk.AutoCAD.DynamoNodes.BlockReference.ByCoordinateSystem(sourceBlock=blockByName, coordinateSystem=code_block, layer=valueAtKey_6, block=modelSpace)

# group: Visualize corridor feature lines
# note: This just helps visualize the corridor feature lines in Dynamo and doesn't have any effect on the rest of the graph.
polyCurve = Autodesk.Civil.DynamoNodes.CorridorFeatureLine.PolyCurve(corridorFeatureLine=corridorFeatureLinesByCode)

# group: Input
# note: Set this to 'True' if you want to display the corridor solids in Dynamo. Note that this will make the graph run slower, and solids will only be displayed if they have been extracted from the corridor and are already present in Model Space.
show_corridor_solids = BoolSelector(false)

# group: Visualize corridor solids
# These nodes are only here to provide more context in Dynamo. They don't have any effect on the rest of the graph's functionality.
current_4 = Autodesk.AutoCAD.DynamoNodes.Document.Current()
corridors = Corridors(document=current_4)
getSolids = Autodesk.Civil.DynamoNodes.Corridor.GetSolids(corridor=corridors)
geometry = Autodesk.AutoCAD.DynamoNodes.Object.Geometry(object=getSolids)
transparency = DoubleSlider(20, range=0..255 step 1)
byARGB = Color.ByARGB(alpha=transparency)
byGeometryColor = Modifiers.GeometryColor.ByGeometryColor(geometry=geometry, color=byARGB)
code_block_2 = CodeBlock { null; }
# note: This is a cool node. It will only run the node connected to the 'true' port (and all of its upstream nodes) if the test condition is met. This is a great way to selectively run different parts of the graph.
# IMPORTANT
# The 'true' and 'false' branches should be totally independent and not connected to any other nodes in the graph that you always want to run.
scopeIf = ScopedIf(test=show_corridor_solids, true=byGeometryColor, false=code_block_2)
