# Dynamo graph Roads_CorridorRegionBoundaries.dyn (Dynamo 2.18.0.4931)
# author: Autodesk, Inc.
# Creates a closed polyline for each region in a corridor.

# group: Input
select_corridor = ObjectSelection()  # nothing selected; graph input

# group: Get the stations for each region in each baseline
baselines = Autodesk.Civil.DynamoNodes.Corridor.Baselines(corridor=select_corridor)
regions = Autodesk.Civil.DynamoNodes.Baseline.Regions(baseline=baselines)
# note: The corridor may contain empty baselines without any regions in them, so it's a good idea to filter those out right at the start so we don't errors later on.
isEmpty = List.IsEmpty(list=regions@L2)
filterByBoolMask = List.FilterByBoolMask(list=baselines, mask=isEmpty)
name = Autodesk.Civil.DynamoNodes.Baseline.Name(baseline=filterByBoolMask.out)
filterByBoolMask_2 = List.FilterByBoolMask(list=regions, mask=isEmpty)
# note: This returns the list of stations where assemblies are inserted along the corridor.
stations = Autodesk.Civil.DynamoNodes.BaselineRegion.Stations(baselineRegion=filterByBoolMask_2.out)

# group: Visualize the corridor
# Get the Dynamo polycurve geometry for all the corridor feature lines, then display them in Dynamo space with a specified color. This is purely for reference purposes only and has no effect on the rest of the graph.
corridorFeatureLines = Autodesk.Civil.DynamoNodes.Baseline.CorridorFeatureLines(baseline=filterByBoolMask.out)
polyCurve = Autodesk.Civil.DynamoNodes.CorridorFeatureLine.PolyCurve(corridorFeatureLine=corridorFeatureLines)
color_palette = ColorPalette({R: 221, G: 160, B: 221, A: 255})
byGeometryColor = Modifiers.GeometryColor.ByGeometryColor(geometry=polyCurve, color=color_palette)

# group: Get the points for each point code
# note: IMPORTANT
# This graph assumes that the corridor contains "Top" link codes, and that the those links extend to the furthest outer limits of the corridor. This is most likely the case in the majority of circumstances, but the logic may need to be adjusted for corridors that don't follow this pattern.
string = StringInput("Top")
pointsByLinkCodeAtNearestStation = Autodesk.Civil.DynamoNodes.Baseline.PointsByLinkCodeAtNearestStation(baseline=filterByBoolMask.out, station=stations, code=string)
# note: We can simplify the list structure a little bit here moving forward because we aren't concerned with keeping track of the different point codes for each point. All we care about from this point on is the point geometry.
flatten = List.Flatten(list=pointsByLinkCodeAtNearestStation.Points@@L3)

# group: Sort the points by offset
stationOffsetByPoint = Autodesk.Civil.DynamoNodes.Baseline.StationOffsetByPoint(baseline=filterByBoolMask.out, point=flatten)
# note: The points are currently grouped by station, and then this node sorts the points at each station by their offset from the baseline.
sortByKey = List.SortByKey(list=flatten@@L2, keys=stationOffsetByPoint.Offset@L2)

# group: Get the points furthest from the baseline
# note: Similarly, the point furthest from the baseline on the right (i.e., positive offset) will be the last point in the list.
lastItem = List.LastItem(list=sortByKey.sortedList@@L2)
# note: The points are sorted sequentially by station, so we need to reverse the order of the points on one side so that the polylines will be created properly. In this case, we choose to reverse the points on the right side to yield a clockwise ordering for the points.
reverse = List.Reverse(list=lastItem@@L2)
# note: After sorting by offset, the point furthest from the baseline on the left (i.e., negative offset) will be the first point in the list.
firstItem = List.FirstItem(list=sortByKey.sortedList@@L2)
# note: Now we add the list of right points to the end of the list of left points to create the full list of points for the region. Again, these will be ordered in a clockwise fashion.
addItemToEnd = List.AddItemToEnd(item=reverse@L2, list=firstItem@@L2)
flatten_2 = List.Flatten(list=addItemToEnd@@L3)

# group: Flatten points to XY plane
X = Point.X(point=flatten_2)
Y = Point.Y(point=flatten_2)
byCoordinates = Point.ByCoordinates(x=X, y=Y)

# group: Get region areas
boolean = BoolSelector(true)
byPoints = PolyCurve.ByPoints(points=byCoordinates, connectLastToFirst=boolean)
byPatch = Surface.ByPatch(closedCurve=byPoints)
area = Surface.Area(surface=byPatch)
code_block = CodeBlock { 2; }
round = Math.Round(number=area, digits=code_block)

name_2 = Autodesk.Civil.DynamoNodes.BaselineRegion.Name(baselineRegion=filterByBoolMask_2.out)

# group: Prep output for Dynamo Player
code_block_2 = CodeBlock { ["Region","Area"]; }
addItemToEnd_2 = List.AddItemToEnd(item=round@L1, list=name_2@@L1)
byKeysValues = DesignScript.Builtin.Dictionary.ByKeysValues(keys=code_block_2@L2, values=addItemToEnd_2@@L2, lacing=Longest)
byKeysValues_2 = DesignScript.Builtin.Dictionary.ByKeysValues(keys=name, values=byKeysValues)
region_areas = Watch(byKeysValues_2)  # graph output

# group: Create the polylines
current = Autodesk.AutoCAD.DynamoNodes.Document.Current()
modelSpace = Autodesk.AutoCAD.DynamoNodes.Document.ModelSpace(document=current)
byPoints_2 = Autodesk.AutoCAD.DynamoNodes.Polyline.ByPoints(points=byCoordinates, layer=name_2, block=modelSpace)
boolean_2 = BoolSelector(true)
setClosed = Autodesk.AutoCAD.DynamoNodes.Polyline.SetClosed(polyline=byPoints_2, value=boolean_2)
