# Dynamo graph Survey_CreatePointGroups (1).dyn "Survey_CreatePointGroups" (Dynamo 2.15.1.6076)
# author: Autodesk, Inc.
# Assigns COGO Points to Point Groups according to their descriptions.

current = Autodesk.AutoCAD.DynamoNodes.Document.Current()

# group: Get all COGO points in the drawing
# note: First, get all of the point groups in the drawing.
cogoPointGroups = CogoPointGroups(document=current)
# note: Next, get all of the points in each point group. This will return a list that contains multiple lists of points (one for each point group).
cogoPoints = Autodesk.Civil.DynamoNodes.CogoPointGroup.CogoPoints(cogoPointGroup=cogoPointGroups)
# note: Moving forward, we just want to lump all of the points together in a single list, which is referred to as "flattening" the list.
flatten = List.Flatten(list=cogoPoints)

# group: Group the points by description
rawDescription = Autodesk.Civil.DynamoNodes.CogoPoint.RawDescription(cogoPoint=flatten)
# note: This is where the magic happens! The List.GroupByKey node puts all of the points that share the same description into a list, and repeats that for each unique description.
groupByKey = List.GroupByKey(list=flatten, keys=rawDescription)

# group: Create point groups
# note: And the final step...create a point group for each of the unique point descriptions, putting the points into their respective groups.
byCogoPoints = Autodesk.Civil.DynamoNodes.CogoPointGroup.ByCogoPoints(cogoPoints=groupByKey.groups, cogoPointGroupName=groupByKey.uniqueKeys, document=current)

# group: Show point group names in Dynamo Player
# note: If you right-click on this node, you'll see that it is set to "Is Output." This means that if you run the graph in Dynamo Player, the contents of the node (in this case, the names of the new point groups) will be displayed as an output after the graph is finished running.
point_groups_created = Watch(groupByKey.uniqueKeys)  # graph output
