# Dynamo graph Survey_CreateStakingPoints.dyn (Dynamo 2.18.0.4931)
# author: Autodesk, Inc.
# Creates COGO Points at all intersection points between lot, right-of-way, and boundary lines.

# group: Input
lot_layer = StringInput("C-PROP-LOTS")  # graph input
row_layer = StringInput("C-PROP-ROW")  # graph input
boundary_layer = StringInput("C-PROP-BNDY")  # graph input

# note: Combine all of the layer names together into a single list so we can grab all of the geometry at once.
list_create = List.Create(item0=lot_layer, item1=row_layer, item2=boundary_layer)

# group: Get curve geometry
current = Autodesk.AutoCAD.DynamoNodes.Document.Current()
modelSpace = Autodesk.AutoCAD.DynamoNodes.Document.ModelSpace(document=current)
# note: This will give us a list of all the objects in Model Space on the specified layers.
all_objects_on_layer = AcObjectsOnLayer(layer=list_create, block=modelSpace)
# note: Once we have the objects, we need to get their actual geometry in Dynamo space.
geometry = Autodesk.AutoCAD.DynamoNodes.Object.Geometry(object=all_objects_on_layer)
# note: You'll see that the output from the previous node is a list of lists (one for each set of objects on each layer). We don't really need to preserve that list structure moving forward, so we'll just "flatten" everything into a single list. This will make things easier to work with moving forward.
flatten = List.Flatten(list=geometry)

# group: Get all intersection points
# note: This is where it gets cool. We want to find the intersection points between every object and every other object, and this node does the trick not that the lacing for the node is set to "Cross Product," which you can tell by the XXX in the bottom right corner. You can read more about node lacing settings in the Primer.
intersect = Geometry.Intersect(geometry=flatten, other=flatten, lacing=CrossProduct)
# note: Now we're back to a big messy list again, since there are multiple intersections per object. Like before, we don't really need to preserve the list structure, so we'll just flatten it again.
flatten_2 = List.Flatten(list=intersect)
string = StringInput("Point")
# note: You'll notice that the result of the intersection magic gave us more than just points. Why? The intersection node computed the intersection of every object with every other object, including itself. What happens when you intersect a line with itself? You just get the same line! So we need to filter out all of those extra lines that we don't want.
removeIfNot = List.RemoveIfNot(list=flatten_2, type=string)
# note: There's also a bunch of duplicate points that got created during the intersection magic, so we need to remove them from the list do we don't end up creating duplicate COGO points.
pruneDuplicates = Point.PruneDuplicates(points=removeIfNot)

# group: Input
# note: Points that are within this distance of each other in the X direction will be considered part of the same "group" when sorting the point numbers.
sorting_threshold = IntegerSlider(120, range=5..300 step 5)  # graph input

# group: Sort points by location
# If we don't do anything to sort the points before we create COGO points, then the point numbering will simply match the order that the original curve objects were created in Model Space, which isn't very useful. These nodes provide a logical means of sorting the points by their location.
# note: First, we get the X coordinate of each point.
X = Point.X(point=pruneDuplicates)
# note: This basically rounds the coordinate value down to the nearest multiple of the threshold.
code_block = CodeBlock(coord=X, threshold=sorting_threshold) { Math.Floor(coord/threshold) * threshold; }
# note: This groups points together that share the same rounded value that we calculated before. So what we end up with is groups of points whose X coordinates are within [threshold] units of each other.
groupByKey = List.GroupByKey(list=pruneDuplicates, keys=code_block)
# note: Next, we sort the grouped points in order of increasing X coordinates.
sortByKey = List.SortByKey(list=groupByKey.groups, keys=groupByKey.uniqueKeys)
# note: Now we get the Y coordinates of points that were grouped by X.
Y = Point.Y(point=sortByKey.sortedList)
# note: Lastly, we sort the grouped points by increasing Y values. You can think of the end result as "columns" of points that are sorted such that their numbering will increase from bottom to top. The width of each "column" is the threshold value we used earlier.
sortByKey_2 = List.SortByKey(list=sortByKey.sortedList@L2, keys=Y@L2)

# group: Input
point_layer = StringInput("V-NODE")  # graph input
point_style = StringInput("Basic")  # graph input
point_label_style = StringInput("Point Number Only")  # graph input
point_group_name = StringInput("Staking Points")  # graph input

current_2 = Autodesk.AutoCAD.DynamoNodes.Document.Current()

# group: Create COGO points
byGeometry = Autodesk.Civil.DynamoNodes.CogoPoint.ByGeometry(geometry=sortByKey_2.sortedList, layer=point_layer, document=current_2)

# group: Set point style
setStyle = Autodesk.Civil.DynamoNodes.CogoPoint.SetStyle(cogoPoint=byGeometry, style=point_style)

# group: Set point label style
setLabelStyle = Autodesk.Civil.DynamoNodes.CogoPoint.SetLabelStyle(cogoPoint=setStyle, labelStyle=point_label_style)

# group: Create point group and add points
current_3 = Autodesk.AutoCAD.DynamoNodes.Document.Current()
byCogoPoints = Autodesk.Civil.DynamoNodes.CogoPointGroup.ByCogoPoints(cogoPoints=setLabelStyle, cogoPointGroupName=point_group_name, document=current_3)

# note: All this node does is output whatever the input is, unchanged. It's only here to help make the node connections (wires) not look so confusing!
identity = Object.Identity(object=sortByKey.sortedKeys)

# group: Visualize the grouping/sorting "columns" > Calculate column height
flatten_3 = List.Flatten(list=sortByKey_2.sortedList)
byGeometry_2 = BoundingBox.ByGeometry(geom=flatten_3)
minPoint = BoundingBox.MinPoint(boundingBox=byGeometry_2)
Y_2 = Point.Y(point=minPoint)
maxPoint = BoundingBox.MaxPoint(boundingBox=byGeometry_2)
Y_3 = Point.Y(point=maxPoint)
code_block_2 = CodeBlock(maxY=Y_3, minY=Y_2) { height = maxY - minY; }

# group: Visualize the grouping/sorting "columns" > Generate column geometry
byCoordinates = Point.ByCoordinates(x=identity, y=Y_2)
XAxis = Vector.XAxis()
byStartPointDirectionLength = Line.ByStartPointDirectionLength(startPoint=byCoordinates, direction=XAxis, length=sorting_threshold)
YAxis = Vector.YAxis()
extrude = Curve.Extrude(curve=byStartPointDirectionLength, direction=YAxis, distance=code_block_2)

# group: Visualize the grouping/sorting "columns" > Assign random colors to columns
transparency = IntegerSlider(75, range=0..255 step 1)
count = List.Count(list=extrude)
randomList = Math.RandomList(amount=count)
number = DoubleInput(255)
remapRange = Math.RemapRange(numbers=randomList, newMax=number)
shuffle = List.Shuffle(list=remapRange)
shuffle_2 = List.Shuffle(list=shuffle)
byARGB = Color.ByARGB(alpha=transparency, red=remapRange, green=shuffle, blue=shuffle_2)
byGeometryColor = Modifiers.GeometryColor.ByGeometryColor(geometry=extrude, color=byARGB)
