# Dynamo graph Top-Down-Hierarchy (1).dyn (Dynamo 0.8.1.1942)

code_block = CodeBlock { 0..2; 0..3; }
watch = Watch(code_block.out0)
watch_2 = Watch(code_block.out1)
byCoordinates = Point.ByCoordinates(x=code_block.out0, y=code_block.out1, lacing=CrossProduct)
code_block_2 = CodeBlock { 0; }
getItemAtIndex = List.GetItemAtIndex(list=byCoordinates, index=code_block_2)
watch_3 = Watch(byCoordinates)
