# Dynamo graph Utilities_RenameStructures (1).dyn "Utilities_RenameStructures" (Dynamo 2.15.1.6076)
# author: Autodesk, Inc.
# Renames pipe network structures sequentially along an alignment.

# group: Input
# note: By default, the structures will be sorted by increasing station values. Toggle this to change the direction.
sort_by_increasing_station = BoolSelector(true)  # graph input

# group: Input
structures_layer = StringInput("C-STRM-STRC")  # graph input

# group: Get all objects on layer
current = Autodesk.AutoCAD.DynamoNodes.Document.Current()
modelSpace = Autodesk.AutoCAD.DynamoNodes.Document.ModelSpace(document=current)
# note: Here we "select" all of the objects in Model Space on the specified layer, which may include a mix of different object types.
all_objects_on_layer = AcObjectsOnLayer(layer=structures_layer, block=modelSpace)
string = StringInput("CivilObject")
# note: This is just to ensure that we only consider "named" Civil 3D objects (i.e., things that can be named, such as pipes, structures, alignments, etc.)
removeIfNot = List.RemoveIfNot(list=all_objects_on_layer, type=string)

# group: Input
# note: The structures will be renamed by the order of their stationing along this alignment.
select_alignment = ObjectSelection()  # nothing selected; graph input

# group: Get approximate structure insertion points
# note: Every object has what is called a "bounding box," which is the minimum-size rectangle (or cube for 3D objects) that fully encompases the object. We'll take advantage of this fact to get a point at the approximate center of the structure.
extents = Autodesk.AutoCAD.DynamoNodes.Object.Extents(object=removeIfNot)
minPoint = BoundingBox.MinPoint(boundingBox=extents)
maxPoint = BoundingBox.MaxPoint(boundingBox=extents)
# note: What we're doing here is figuring out the approximate insertion point for the structure. It's "approximate" because it is the center of the structure's bounding box, which is a pretty good approximation for these purposes.
code_block = CodeBlock(bboxMinPnt=minPoint, bboxMaxPnt=maxPoint)
# ---------- code_block.designscript (4 lines) ----------
midPntX = Point.X(bboxMinPnt) + (Point.X(bboxMaxPnt) - Point.X(bboxMinPnt)) / 2;
midPntY = Point.Y(bboxMinPnt) + (Point.Y(bboxMaxPnt) - Point.Y(bboxMinPnt)) / 2;
midPntZ = Point.Z(bboxMinPnt) + (Point.Z(bboxMaxPnt) - Point.Z(bboxMinPnt)) / 2;
midPnt = Point.ByCoordinates(midPntX, midPntY, Point.Z(bboxMaxPnt));
# ----------------------------------------

# group: Get structure station/offset
stationOffsetByPoint = Autodesk.Civil.DynamoNodes.Alignment.StationOffsetByPoint(alignment=select_alignment, point=code_block.midPnt)

# group: Input
# note: Only the structures that are within this distance from the alignment will be renamed.
max_offset_from_alignment = DoubleSlider(20, range=1..50 step 1)  # graph input

# group: Filter structures by max offset from alignment
abs = Math.Abs(number=stationOffsetByPoint.Offset)
# note: This goes through each structure and returns a true if the structure is within the threshold distance from the alignment, and false otherwise.
lt = abs < max_offset_from_alignment
# note: We need to do a little housekeeping here. Depending on which alignment is chosen, there will likely be some structures that are not within its station range, which will give us null values. What we need to do here is replace the null values with 'false' so that the rest of the graph works as expected.
code_block_2 = CodeBlock(value=lt) { value == null ? false : value; }
# note: Using the true/false values from before, we can then filter the list of structures and stations to separate out the ones that were false (i.e., too far away from the alignment).
filterByBoolMask = List.FilterByBoolMask(list=removeIfNot, mask=code_block_2)
filterByBoolMask_2 = List.FilterByBoolMask(list=stationOffsetByPoint.Station, mask=code_block_2)
filterByBoolMask_3 = List.FilterByBoolMask(list=extents, mask=code_block_2)

# group: Sort structures by station
# note: Once we have the filtered out the stuff we don't want, we can sort the structures by their station values. By default, they will be sorted in a descending fashion (lowest stations first).
sortByKey = List.SortByKey(list=filterByBoolMask.in, keys=filterByBoolMask_2.in)

# group: Reverse sorting if desired
reverse = List.Reverse(list=sortByKey.sortedList)
if_ = RefactoredIf(test=sort_by_increasing_station, true=sortByKey.sortedList, false=reverse)

# group: Format alignment name
name = Autodesk.Civil.DynamoNodes.CivilObject.Name(civilObject=select_alignment)
toUpper = String.ToUpper(string=name)

# group: Input
pad_numbers_with_zeroes = BoolSelector(true)  # graph input

# group: INPUT
start_number = DoubleInput(1)  # graph input

# group: Generate new names
count = List.Count(list=if_)
# note: First, we generate the sequence of numbers that we want based on the total number of structures.
sequence = Sequence(start=start_number, amount=count)
# note: By default, a number is not a string (i.e., text). So we need to explicitly convert the numbers to strings so we can use them as strings later.
string_from_object = FromObject(object=sequence)
# note: Depending on how many structures there are, there will be a different number of zeroes to "pad" the numbers with. You'll see that this code block uses some '?' and ':' characters. Those are a shorthand way of writing an if/else conditional statement.
code_block_3 = CodeBlock(count=count)
# ---------- code_block_3.designscript (8 lines) ----------
// If the count is less than 100, output a "0"
count < 100
	? "0"
	// Otherwise if the count is between 100 and 1000, output "00"
	: count >= 100 && count < 1000
		? "00"
		// Otherwise output "000"
		: "000";
# ----------------------------------------
code_block_4 = CodeBlock(padChars=code_block_3) { String.Length(padChars) + 1; }
# note: This does the actual work of "padding" the numbers with zeroes. Take a look at the node output to see the result!
padLeft = String.PadLeft(string=string_from_object, newLength=code_block_4, padChars=code_block_3)
# note: But wait! What if you (or someone else that uses this graph) doesn't want to pad the numbers with zeroes? Then they can just flip this switch, and the regular numbers will be used instead.
if_2 = RefactoredIf(test=pad_numbers_with_zeroes, true=padLeft, false=string_from_object)
# note: Here we put it all together and generate the new names for the structures. Finally!
code_block_5 = CodeBlock(alignName=toUpper, num=if_2) { alignName + "-STRC-" + num; }

# group: Rename structures
# note: And of course, we need to actually set the names of the structures in Civil 3D.
setName = Autodesk.Civil.DynamoNodes.CivilObject.SetName(civilObject=if_, name=code_block_5)

# group: Visualize the corridors in the drawing
# Get the Dynamo polycurve geometry for all the corridor feature lines, then display them in Dynamo space with a specified color. This is purely for reference purposes only and has no effect on the rest of the graph.
current_2 = Autodesk.AutoCAD.DynamoNodes.Document.Current()
corridors = Corridors(document=current_2)
baselines = Autodesk.Civil.DynamoNodes.Corridor.Baselines(corridor=corridors)
corridorFeatureLines = Autodesk.Civil.DynamoNodes.Baseline.CorridorFeatureLines(baseline=baselines)
polyCurve = Autodesk.Civil.DynamoNodes.CorridorFeatureLine.PolyCurve(corridorFeatureLine=corridorFeatureLines)
color_palette = ColorPalette({R: 220, G: 220, B: 220, A: 255})
byGeometryColor = Modifiers.GeometryColor.ByGeometryColor(geometry=polyCurve, color=color_palette)

# group: Visualize the structures
# Get the Dynamo bounding box geometry for all the structures, then display them in Dynamo space with their layer color. This is purely for reference purposes only and has no effect on the rest of the graph.
toCuboid = BoundingBox.ToCuboid(boundingBox=filterByBoolMask_3.in)
current_3 = Autodesk.AutoCAD.DynamoNodes.Document.Current()
layer = Autodesk.AutoCAD.DynamoNodes.Object.Layer(object=removeIfNot)
layerByName = Autodesk.AutoCAD.DynamoNodes.Document.LayerByName(document=current_3, name=layer)
color = Autodesk.AutoCAD.DynamoNodes.Layer.Color(layer=layerByName)
byGeometryColor_2 = Modifiers.GeometryColor.ByGeometryColor(geometry=toCuboid, color=color)
