# Dynamo graph roomDictionary.dyn "9-4_roomDictionary" (Dynamo 2.0.0.4654)

# group: Collect all rooms in the model.
categories = Categories(index=416)
all_elements_of_category = ElementsOfCategory(Category=categories)

# group: Get the room number to use as the key
number = Room.Number(room=all_elements_of_category)

# group: Create Dictionary
byKeysValues = DesignScript.Builtin.Dictionary.ByKeysValues(keys=number, values=all_elements_of_category)

# group: Room Number To Find
string = StringInput("201")

# group: Get the room element given it's number
valueAtKey = DesignScript.Builtin.Dictionary.ValueAtKey(dictionary=byKeysValues, key=string)
